vi "IV_Scan.gvi"   [LabVIEW NXG 2.1.0]
panel controls:
  "Sourcemeter 1 ON": bool
  "Sourcemeter 3 ON": bool
  "Sourcemeter 2 ON": bool
  "RAMP UP": bool
  "Maximum Voltage 1": f64 = -200
  "Voltage Step Width 3": f64 = -10
  "Compliance Level 1": f64 = 6e-06  # Sets the maximum value for the value not regulated by the Source Mode control. For instance, if the instrument was suppling a voltage, the compliance value would be in amps. Valid Range: 2400: -1.05 A to 1.05 A -210 V to 210 V 2410: -1.05 A to 1.05 A -1100V to 1100V 2420: -3.15 A to 3.15 A -63 V to 63 V 2425 and 2430: -3.15 A to 3.15 A -105 V to 105 V 2430 Pulse Mode: -10.5 A to 10.5 A -105 V to 105 V 2440: -5.25 to 5.25 A -42 V to 42 V
  "Maximum Voltage 2": f64 = -200
  "Maximum Voltage 3": f64 = -200
  "Ramp Up Delay": f64 = 1500
  "Compliance Level 2": f64 = 6e-06  # Sets the maximum value for the value not regulated by the Source Mode control. For instance, if the instrument was suppling a voltage, the compliance value would be in amps. Valid Range: 2400: -1.05 A to 1.05 A -210 V to 210 V 2410: -1.05 A to 1.05 A -1100V to 1100V 2420: -3.15 A to 3.15 A -63 V to 63 V 2425 and 2430: -3.15 A to 3.15 A -105 V to 105 V 2430 Pulse Mode: -10.5 A to 10.5 A -105 V to 105 V 2440: -5.25 to 5.25 A -42 V to 42 V
  "Compliance Level 3": f64 = 6e-06  # Sets the maximum value for the value not regulated by the Source Mode control. For instance, if the instrument was suppling a voltage, the compliance value would be in amps. Valid Range: 2400: -1.05 A to 1.05 A -210 V to 210 V 2410: -1.05 A to 1.05 A -1100V to 1100V 2420: -3.15 A to 3.15 A -63 V to 63 V 2425 and 2430: -3.15 A to 3.15 A -105 V to 105 V 2430 Pulse Mode: -10.5 A to 10.5 A -105 V to 105 V 2440: -5.25 to 5.25 A -42 V to 42 V
  "Voltage Step Width 2": f64 = -10
  "Voltage Step Width 1": f64 = -10
  "Time for current to stabilize": f64 = -10
  "Ramp Down Delay": f64 = 1500
  "File Path": path
  "Output 1 V": f32[]
  "Output 1 I": f32[]
  "Output 2 I": f32[]
  "Output 2 V": f32[]
  "Output 3 I": f32[]
  "Output 3 V": f32[]
panel indicators:
  "Sourcemeter 1": bool
  "Sourcemeter 2": bool
  "Sourcemeter 3": bool
  "VISA resource name out_2": "Instr"
  "VISA resource name out_3": "Instr"
  "VISA resource name out": "Instr"
  "ALL INSTRUMENTS": bool
  "Present State": string
  "Voltage Waveform (SourceMeter 1)": f32[]
  "Current Waveform (SourceMeter 1)": f32[]
  "finished ramping 1": bool
  "Voltage Waveform (SourceMeter 2)": f32[]
  "Current Waveform (SourceMeter 2)": f32[]
  "finished ramping 2": bool
  "Voltage Waveform (SourceMeter 3)": f32[]
  "Current Waveform (SourceMeter 3)": f32[]
  "finsihed ramping 3": bool
  "Present State_2": string
  "RAMP DOWN": bool
uses:
  NI::VISA::Close (Instr).gvi
  Keithley 24XX::Initialize.gvi
  Keithley 24XX::Configure Measurement.gvi
  NI::VISA::Write (Instr, String).gvi
  NI::G Core::Error::Is Error.gvi
  Keithley 24XX::Configure Output.gvi
  Keithley 24XX::Enable Output.gvi
  Keithley 24XX::Read (Multiple Points).gvi
diagram:
  case ($"Sourcemeter 1 ON") {
    frame False, Default {
      w1 = ""
    }
    frame True {
      w1 = "GPIB0::24::INSTR"
    }
  }
  call "Close (Instr).gvi"(session in=w1) -> (error out=w2)
  call "Initialize.gvi"(VISA resource name=w1, error in=w2) -> (VISA resource name out=w3, error out=w4)
  call "Configure Measurement.gvi"(VISA resource name=w3, error in=w4, function="Volts"(0)) -> (VISA resource name out=w5, error out=w6)
  call "Configure Measurement.gvi"(VISA resource name=w5, error in=w6, function="Current"(1)) -> (VISA resource name out=w7, error out=w8)
  call "Write (Instr, String).gvi"(session in=w7, error in=w8, write buffer=":FUNC:OFF 'RES'") -> (error out=w9)
  call "Is Error.gvi"(error in=w9) -> (error?=w10)
  case ($"Sourcemeter 1 ON") {
    frame False, Default {
      w11 = FALSE
    }
    frame True {
      w11 = w10
    }
  }
  case ($"Sourcemeter 2 ON") {
    frame False, Default {
      w12 = ""
    }
    frame True {
      w12 = "GPIB0::24::INSTR"
    }
  }
  call "Close (Instr).gvi"(session in=w12) -> (error out=w13)
  call "Initialize.gvi"(VISA resource name=w12, error in=w13) -> (VISA resource name out=w14, error out=w15)
  call "Configure Measurement.gvi"(VISA resource name=w14, error in=w15, function="Volts"(0)) -> (VISA resource name out=w16, error out=w17)
  call "Configure Measurement.gvi"(VISA resource name=w16, error in=w17, function="Current"(1)) -> (VISA resource name out=w18, error out=w19)
  call "Write (Instr, String).gvi"(session in=w18, error in=w19, write buffer=":FUNC:OFF 'RES'") -> (error out=w20)
  call "Is Error.gvi"(error in=w20) -> (error?=w21)
  case ($"Sourcemeter 2 ON") {
    frame False, Default {
      w22 = FALSE
    }
    frame True {
      w22 = w21
    }
  }
  case ($"Sourcemeter 3 ON") {
    frame False, Default {
      w23 = ""
    }
    frame True {
      w23 = "GPIB0::18::INSTR"
    }
  }
  call "Close (Instr).gvi"(session in=w23) -> (error out=w24)
  call "Initialize.gvi"(VISA resource name=w23, error in=w24) -> (VISA resource name out=w25, error out=w26)
  call "Configure Measurement.gvi"(VISA resource name=w25, error in=w26, function="Volts"(0)) -> (VISA resource name out=w27, error out=w28)
  call "Configure Measurement.gvi"(VISA resource name=w27, error in=w28, function="Current"(1)) -> (VISA resource name out=w29, error out=w30)
  call "Write (Instr, String).gvi"(session in=w29, error in=w30, write buffer=":FUNC:OFF 'RES'") -> (error out=w31)
  call "Is Error.gvi"(error in=w31) -> (error?=w32)
  case ($"Sourcemeter 3 ON") {
    frame False, Default {
      w33 = FALSE
    }
    frame True {
      w33 = w32
    }
  }
  Logical Or(w11, w22, w33) -> w34
  Not(x=w34) -> w35
  while {
    Logical And($"RAMP UP", w35) -> w36
    stop if w36
  }
  case (w36) {
    frame False, Default {
      w47 = "If instruments ready, press ramp up! If instruments not ready try executing again."
      $"Present State" <- w47
      w37 = FALSE
      w38 = default
      w39 = default
      w40 = default
      w41 = default
      w42 = default
      w43 = default
      w44 = default
      w45 = default
      w46 = default
    }
    frame True {
      w48 = $"Compliance Level 3"
      w49 = $"Voltage Step Width 3"
      w50 = $"Maximum Voltage 3"
      case ($"Sourcemeter 3") {
        frame False, Default {
          w51 = TRUE
          w42 = default
          w43 = default
          w44 = default
        }
        frame True {
          s1 = 0  # shift register
          s2 = uninitialised  # shift register
          s3 = uninitialised  # shift register
          while (iteration -> i1) {
            Wait(time to wait=$"Ramp Up Delay")
            Add(s1, w49) -> w52
            call "Configure Output.gvi"(VISA resource name=$"VISA resource name out_3", output level=w52, compliance level=w48, source mode="Voltage"(0)) -> (VISA resource name out=w53, error out=w54)
            call "Enable Output.gvi"(VISA resource name=w53, error in=w54, enable output=TRUE) -> (VISA resource name out=w55, error out=w56)
            case (TRUE) {
              frame False, Default {
                w57 = default
                w58 = default
              }
              frame True {
                Wait(time to wait=$"Time for current to stabilize")
                w57 = w55
                w58 = w56
              }
            }
            call "Read (Multiple Points).gvi"(output mode="list"(0), VISA resource name=w57, error in=w58) -> (VISA resource name out=w59, error out=w60, current=w61, voltage=w62)
            $"Voltage Waveform (SourceMeter 3)" <- w62
            Insert Into Array(inArray=s2, index0=i1, new=w62) -> w63
            call "Enable Output.gvi"(VISA resource name=w59, error in=w60, enable output=TRUE) -> (VISA resource name out=w64, error out=w65)
            Subtract(x=w50, y=w49) -> w66
            Is Less(x=w52, y=w66) -> w67
            Not(x=TRUE) -> w68
            Logical Or(w67, w68) -> w51
            $"finsihed ramping 3" <- w51
            $"Current Waveform (SourceMeter 3)" <- w61
            Insert Into Array(inArray=s3, index0=i1, new=w61) -> w69
            next s1 = w52
            next s2 = w63
            next s3 = w69
            stop if w51
          }
          w42 = s2
          w43 = s3
          w44 = i1
        }
      }
      w70 = $"Maximum Voltage 1"
      w71 = $"Voltage Step Width 1"
      w72 = $"Compliance Level 1"
      # Ramp up mechanism
      case ($"Sourcemeter 1") {
        frame False, Default {
          w73 = TRUE
          w38 = default
          w39 = default
          w45 = default
        }
        frame True {
          s4 = 0  # shift register
          s5 = uninitialised  # shift register
          s6 = uninitialised  # shift register
          while (iteration -> i2) {
            Wait(time to wait=$"Ramp Up Delay")
            Subtract(x=w70, y=w71) -> w74
            Add(s4, w71) -> w75
            Is Less(x=w75, y=w74) -> w76
            Not(x=TRUE) -> w77
            Logical Or(w76, w77) -> w73
            $"finished ramping 1" <- w73
            call "Configure Output.gvi"(VISA resource name=$"VISA resource name out", output level=w75, compliance level=w72, source mode="Voltage"(0)) -> (VISA resource name out=w78, error out=w79)
            call "Enable Output.gvi"(VISA resource name=w78, error in=w79, enable output=TRUE) -> (VISA resource name out=w80, error out=w81)
            case (TRUE) {
              frame False, Default {
                w82 = default
                w83 = default
              }
              frame True {
                Wait(time to wait=$"Time for current to stabilize")
                w82 = w81
                w83 = w80
              }
            }
            call "Read (Multiple Points).gvi"(output mode="list"(0), VISA resource name=w83, error in=w82) -> (VISA resource name out=w84, error out=w85, current=w86, voltage=w87)
            $"Voltage Waveform (SourceMeter 1)" <- w87
            Insert Into Array(inArray=s5, index0=i2, new=w87) -> w88
            call "Enable Output.gvi"(VISA resource name=w84, error in=w85, enable output=TRUE) -> (VISA resource name out=w89, error out=w90)
            $"Current Waveform (SourceMeter 1)" <- w86
            Insert Into Array(inArray=s6, index0=i2, new=w86) -> w91
            next s4 = w75
            next s5 = w88
            next s6 = w91
            stop if w73
          }
          w38 = s5
          w39 = s6
          w45 = i2
        }
      }
      w92 = $"Compliance Level 2"
      w93 = $"Voltage Step Width 2"
      w94 = $"Maximum Voltage 2"
      case ($"Sourcemeter 2") {
        frame False, Default {
          w95 = TRUE
          w40 = default
          w41 = default
          w46 = default
        }
        frame True {
          s7 = 0  # shift register
          s8 = uninitialised  # shift register
          s9 = uninitialised  # shift register
          while (iteration -> i3) {
            Wait(time to wait=$"Ramp Up Delay")
            Add(s7, w93) -> w96
            call "Configure Output.gvi"(VISA resource name=$"VISA resource name out_2", output level=w96, compliance level=w92, source mode="Voltage"(0)) -> (VISA resource name out=w97, error out=w98)
            call "Enable Output.gvi"(VISA resource name=w97, error in=w98, enable output=TRUE) -> (VISA resource name out=w99, error out=w100)
            case (TRUE) {
              frame False, Default {
                w101 = default
                w102 = default
              }
              frame True {
                Wait(time to wait=$"Time for current to stabilize")
                w101 = w99
                w102 = w100
              }
            }
            call "Read (Multiple Points).gvi"(output mode="list"(0), VISA resource name=w101, error in=w102) -> (VISA resource name out=w103, error out=w104, current=w105, voltage=w106)
            $"Voltage Waveform (SourceMeter 2)" <- w106
            Insert Into Array(inArray=s8, index0=i3, new=w106) -> w107
            call "Enable Output.gvi"(VISA resource name=w103, error in=w104, enable output=TRUE) -> (VISA resource name out=w108, error out=w109)
            $"Current Waveform (SourceMeter 2)" <- w105
            Insert Into Array(inArray=s9, index0=i3, new=w105) -> w110
            Subtract(x=w94, y=w93) -> w111
            Is Less(x=w96, y=w111) -> w112
            Not(x=TRUE) -> w113
            Logical Or(w112, w113) -> w95
            $"finished ramping 2" <- w95
            next s7 = w96
            next s8 = w107
            next s9 = w110
            stop if w95
          }
          w40 = s8
          w41 = s9
          w46 = i3
        }
      }
      Logical And(w73, w95, w51) -> w37
    }
  }
  case (w37) {
    frame False, Default {
      w121 = "If instruments ready, press ramp up! If instruments not ready try executing again."
      $"Present State_2" <- w121
      w114 = FALSE
      w115 = default
      w116 = default
      w117 = default
      w118 = default
      w119 = default
      w120 = default
    }
    frame True {
      # Ramp Down mechanism
      w122 = $"Voltage Step Width 1"
      w123 = $"Compliance Level 1"
      case ($"Sourcemeter 1") {
        frame False, Default {
          w124 = TRUE
          w115 = default
          w116 = default
        }
        frame True {
          s10 = $"Maximum Voltage 1"  # shift register
          s11 = 0  # shift register
          s12 = $"Output 1 V"  # shift register
          s13 = $"Output 1 I"  # shift register
          s14 = w45  # shift register
          while {
            Wait(time to wait=$"Ramp Down Delay")
            Subtract(x=s10, y=w122) -> w125
            case (s11) {
              frame 0, Default {
                w126 = w125
                w124 = FALSE
              }
              frame 1 {
                w126 = 0
                w124 = TRUE
              }
            }
            call "Configure Output.gvi"(VISA resource name=$"VISA resource name out", output level=w126, compliance level=w123, source mode="Voltage"(0)) -> (VISA resource name out=w127, error out=w128)
            call "Enable Output.gvi"(VISA resource name=w127, error in=w128, enable output=TRUE) -> (VISA resource name out=w129, error out=w130)
            case (TRUE) {
              frame False, Default {
                w131 = default
                w132 = default
              }
              frame True {
                Wait(time to wait=$"Time for current to stabilize")
                w131 = w130
                w132 = w129
              }
            }
            call "Read (Multiple Points).gvi"(output mode="list"(0), VISA resource name=w132, error in=w131) -> (VISA resource name out=w133, error out=w134, current=w135, voltage=w136)
            $"Voltage Waveform (SourceMeter 1)" <- w136
            Increment(x=s14) -> w137
            Insert Into Array(inArray=s12, index0=w137, new=w136) -> w138
            call "Enable Output.gvi"(VISA resource name=w133, error in=w134, enable output=TRUE) -> (VISA resource name out=w139, error out=w140)
            $"Current Waveform (SourceMeter 1)" <- w135
            Insert Into Array(inArray=s13, index0=w137, new=w135) -> w141
            Is Greater(x=w125, y=w122) -> w142
            Select(s=w142, t=1, f=0) -> w143
            next s10 = w126
            next s11 = w143
            next s12 = w138
            next s13 = w141
            next s14 = w137
            stop if w124
          }
          w115 = s12
          w116 = s13
        }
      }
      w144 = $"Voltage Step Width 2"
      w145 = $"Compliance Level 2"
      case ($"Sourcemeter 2") {
        frame False, Default {
          w146 = TRUE
          w117 = default
          w118 = default
        }
        frame True {
          s15 = $"Maximum Voltage 2"  # shift register
          s16 = 0  # shift register
          s17 = $"Output 2 V"  # shift register
          s18 = $"Output 2 I"  # shift register
          s19 = w46  # shift register
          while {
            Wait(time to wait=$"Ramp Down Delay")
            Subtract(x=s15, y=w144) -> w147
            case (s16) {
              frame 0, Default {
                w148 = w147
                w146 = FALSE
              }
              frame 1 {
                w148 = 0
                w146 = TRUE
              }
            }
            call "Configure Output.gvi"(VISA resource name=$"VISA resource name out_2", output level=w148, compliance level=w145, source mode="Voltage"(0)) -> (VISA resource name out=w149, error out=w150)
            call "Enable Output.gvi"(VISA resource name=w149, error in=w150, enable output=TRUE) -> (VISA resource name out=w151, error out=w152)
            case (TRUE) {
              frame False, Default {
                w153 = default
                w154 = default
              }
              frame True {
                Wait(time to wait=$"Time for current to stabilize")
                w153 = w152
                w154 = w151
              }
            }
            call "Read (Multiple Points).gvi"(output mode="list"(0), VISA resource name=w154, error in=w153) -> (VISA resource name out=w155, error out=w156, current=w157, voltage=w158)
            $"Voltage Waveform (SourceMeter 2)" <- w158
            Increment(x=s19) -> w159
            Insert Into Array(inArray=s17, index0=w159, new=w158) -> w160
            call "Enable Output.gvi"(VISA resource name=w155, error in=w156, enable output=TRUE) -> (VISA resource name out=w161, error out=w162)
            $"Current Waveform (SourceMeter 2)" <- w157
            Is Greater(x=w147, y=w144) -> w163
            Select(s=w163, t=1, f=0) -> w164
            Insert Into Array(inArray=s18, index0=w159, new=w157) -> w165
            next s15 = w148
            next s16 = w164
            next s17 = w160
            next s18 = w165
            next s19 = w159
            stop if w146
          }
          w117 = s17
          w118 = s18
        }
      }
      w166 = $"Voltage Step Width 3"
      w167 = $"Compliance Level 3"
      case ($"Sourcemeter 3") {
        frame False, Default {
          w168 = TRUE
          w119 = default
          w120 = default
        }
        frame True {
          s20 = $"Maximum Voltage 3"  # shift register
          s21 = 0  # shift register
          s22 = $"Output 3 V"  # shift register
          s23 = $"Output 3 I"  # shift register
          s24 = w44  # shift register
          while {
            Wait(time to wait=$"Ramp Down Delay")
            Subtract(x=s20, y=w166) -> w169
            Is Greater(x=w169, y=w166) -> w170
            Select(s=w170, t=1, f=0) -> w171
            case (s21) {
              frame 0, Default {
                w172 = w169
                w168 = FALSE
              }
              frame 1 {
                w172 = 0
                w168 = TRUE
              }
            }
            call "Configure Output.gvi"(VISA resource name=$"VISA resource name out_3", output level=w172, compliance level=w167, source mode="Voltage"(0)) -> (VISA resource name out=w173, error out=w174)
            call "Enable Output.gvi"(VISA resource name=w173, error in=w174, enable output=TRUE) -> (VISA resource name out=w175, error out=w176)
            case (TRUE) {
              frame False, Default {
                w177 = default
                w178 = default
              }
              frame True {
                Wait(time to wait=$"Time for current to stabilize")
                w177 = w176
                w178 = w175
              }
            }
            call "Read (Multiple Points).gvi"(output mode="list"(0), VISA resource name=w178, error in=w177) -> (VISA resource name out=w179, error out=w180, current=w181, voltage=w182)
            $"Voltage Waveform (SourceMeter 3)" <- w182
            Increment(x=s24) -> w183
            Insert Into Array(inArray=s22, index0=w183, new=w182) -> w184
            call "Enable Output.gvi"(VISA resource name=w179, error in=w180, enable output=TRUE) -> (VISA resource name out=w185, error out=w186)
            $"Current Waveform (SourceMeter 3)" <- w181
            Insert Into Array(inArray=s23, index0=w183, new=w181) -> w187
            next s20 = w172
            next s21 = w171
            next s22 = w184
            next s23 = w187
            next s24 = w183
            stop if w168
          }
          w119 = s22
          w120 = s23
        }
      }
      Logical And(w124, w146, w168) -> w114
    }
  }
  Not(x=w114) -> w188
  $"RAMP DOWN" <- w188
  case (w114) {
    frame False, Default { }
    frame True {
      Not(x=$"Sourcemeter 2 ON") -> w189
      call "Close (Instr).gvi"(session in=$"VISA resource name out_2") -> (error out=w190)
      call "Is Error.gvi"(error in=w190) -> (error?=w191)
      Not(x=w191) -> w192
      Logical And(w189, w192) -> w193
      $"Sourcemeter 2" <- w193
      case ($"Sourcemeter 2 ON") {
        frame False, Default {
          w194 = FALSE
        }
        frame True {
          w194 = w191
        }
      }
      # Closing Instruments
      call "Close (Instr).gvi"(session in=$"VISA resource name out") -> (error out=w195)
      call "Is Error.gvi"(error in=w195) -> (error?=w196)
      case ($"Sourcemeter 1 ON") {
        frame False, Default {
          w197 = FALSE
        }
        frame True {
          w197 = w196
        }
      }
      call "Close (Instr).gvi"(session in=$"VISA resource name out_3") -> (error out=w198)
      call "Is Error.gvi"(error in=w198) -> (error?=w199)
      case ($"Sourcemeter 3 ON") {
        frame False, Default {
          w200 = FALSE
        }
        frame True {
          w200 = w199
        }
      }
      Logical Or(w197, w194, w200) -> w201
      $"ALL INSTRUMENTS" <- w201
      Not(x=w196) -> w202
      Not(x=$"Sourcemeter 1 ON") -> w203
      Logical And(w203, w202) -> w204
      $"Sourcemeter 1" <- w204
      Not(x=w199) -> w205
      Not(x=$"Sourcemeter 3 ON") -> w206
      Logical And(w206, w205) -> w207
      $"Sourcemeter 3" <- w207
    }
  }
  $"ALL INSTRUMENTS" <- w35
  $"Output 3 I" <- w43
  $"VISA resource name out" <- w7
  $"VISA resource name out_2" <- w18
  $"Output 3 V" <- w42
  $"Output 1 I" <- w39
  $"Output 1 V" <- w38
  $"Output 2 I" <- w41
  Not(x=w10) -> w208
  Logical And($"Sourcemeter 1 ON", w208) -> w209
  $"Sourcemeter 1" <- w209
  $"Output 2 V" <- w40
  Not(x=w21) -> w210
  Logical And($"Sourcemeter 2 ON", w210) -> w211
  $"Sourcemeter 2" <- w211
  $"VISA resource name out_3" <- w29
  Not(x=w32) -> w212
  Logical And($"Sourcemeter 3 ON", w212) -> w213
  $"Sourcemeter 3" <- w213
  Open Or Create Or Replace File(access (0:read/write)="read/write", file path (use dialog)=$"File Path", operation (0:open)="open or create") -> (refnum out=w214)
  Set File Position(from (0:start)="end", refnum=w214) -> (refnum out=w215)
  Build Array(w115, w116, w117, w118, w119, w120) -> w216
  Transpose 2D Array(2D array=w216) -> (transposed array=w217)
  Array To Spreadsheet String(array=w217, format string="%20.15f") -> (spreadsheet string=w218)
  Write To Text File(file (use dialog)=w215, text=w218)
  Not(x=w37) -> w219
  $"RAMP UP" <- w219
