vi "Sidet_Labview.gvi"   [LabVIEW NXG 2.1.0]
panel controls:
  "Sourcemeter 1 ON": bool
  "Sourcemeter 3 ON": bool
  "Sourcemeter 2 ON": bool
  "Sourcemeter 4 ON": bool
  "LV-PSU ON": bool
  "Sourcemeter 5 ON": bool
  "Photek ON": bool
  "DMM ON": bool
  "RAMP UP": bool
  "Ramp Up Delay": f64 = 1500
  "Maximum 1": f64 = -360
  "Ramp Up Step Width": f64 = -10
  "Compliance Level 1": f64 = 0.0002
  "Maximum 2": f64 = -200
  "Maximum 3": f64 = -200
  "Maximum 4": f64 = -200
  "Maximum 5": f64 = -200
  "Voltage": string = "-3800"
  "Ch-1 Voltage": string = "12"
  "Ch-2 Voltage": string = "2"
  "Ch-3 Voltage": string = "2.25"
  "Channel 16 (J0)": string = "16"
  "Channel 17 (J1)": string = "17"
  "Channel 19 (J3)": string = "19"
  "Channel 20 (J4)": string = "20"
  "Channel 18 (J2)": string = "18"
  "RAMP DOWN": bool
  "Ramp Down Step Width": f64 = -10
  "Ramp Down Delay": f64 = 1500
  "CH-16 ON": bool
  "CH-17 ON": bool
  "CH-18 ON": bool
  "CH-19 ON": bool
  "CH-20 ON": bool
  "Compliance Level 2": f64 = 6e-06  # Sets the maximum value for the value not regulated by the Source Mode control. For instance, if the instrument was suppling a voltage, the compliance value would be in amps. Valid Range: 2400: -1.05 A to 1.05 A -210 V to 210 V 2410: -1.05 A to 1.05 A -1100V to 1100V 2420: -3.15 A to 3.15 A -63 V to 63 V 2425 and 2430: -3.15 A to 3.15 A -105 V to 105 V 2430 Pulse Mode: -10.5 A to 10.5 A -105 V to 105 V 2440: -5.25 to 5.25 A -42 V to 42 V
  "Compliance Level 3": f64 = 6e-06  # Sets the maximum value for the value not regulated by the Source Mode control. For instance, if the instrument was suppling a voltage, the compliance value would be in amps. Valid Range: 2400: -1.05 A to 1.05 A -210 V to 210 V 2410: -1.05 A to 1.05 A -1100V to 1100V 2420: -3.15 A to 3.15 A -63 V to 63 V 2425 and 2430: -3.15 A to 3.15 A -105 V to 105 V 2430 Pulse Mode: -10.5 A to 10.5 A -105 V to 105 V 2440: -5.25 to 5.25 A -42 V to 42 V
  "Compliance Level 4": f64 = 6e-06  # Sets the maximum value for the value not regulated by the Source Mode control. For instance, if the instrument was suppling a voltage, the compliance value would be in amps. Valid Range: 2400: -1.05 A to 1.05 A -210 V to 210 V 2410: -1.05 A to 1.05 A -1100V to 1100V 2420: -3.15 A to 3.15 A -63 V to 63 V 2425 and 2430: -3.15 A to 3.15 A -105 V to 105 V 2430 Pulse Mode: -10.5 A to 10.5 A -105 V to 105 V 2440: -5.25 to 5.25 A -42 V to 42 V
  "Compliance Level 5": f64 = 6e-06  # Sets the maximum value for the value not regulated by the Source Mode control. For instance, if the instrument was suppling a voltage, the compliance value would be in amps. Valid Range: 2400: -1.05 A to 1.05 A -210 V to 210 V 2410: -1.05 A to 1.05 A -1100V to 1100V 2420: -3.15 A to 3.15 A -63 V to 63 V 2425 and 2430: -3.15 A to 3.15 A -105 V to 105 V 2430 Pulse Mode: -10.5 A to 10.5 A -105 V to 105 V 2440: -5.25 to 5.25 A -42 V to 42 V
  "CAEN ON": bool
  "voltage 1": string
  "voltage 2": string
  "voltage 3": string
  "voltage 4": string
  "voltage 5": string
  "voltage 6": string
  "voltage 7": string
  "voltage 8": string
  "Channel 5 ON": bool
  "Channel 4 ON": bool
  "Channel 3 ON": bool
  "Channel 2 ON": bool
  "Channel 1 ON": bool
  "Channel 8 ON": bool
  "Channel 7 ON": bool
  "Channel 6 ON": bool
panel indicators:
  "ALL INSTRUMENTS": bool
  "Sourcemeter 1": bool
  "Sourcemeter 2": bool
  "Sourcemeter 3": bool
  "Sourcemeter 4": bool
  "Sourcemeter 5": bool
  "DMM": bool
  "LV-PSU": bool
  "Photek": bool
  "Voltage Waveform (SourceMeter 1)": f32[]
  "Current Waveform (SourceMeter 1)": f32[]
  "Present State": string
  "Voltage Waveform (SourceMeter 2)": f32[]
  "Current Waveform (SourceMeter 2)": f32[]
  "Voltage Waveform (SourceMeter 3)": f32[]
  "Current Waveform (SourceMeter 3)": f32[]
  "Voltage Waveform (SourceMeter 4)": f32[]
  "Current Waveform (SourceMeter 4)": f32[]
  "Voltage Waveform (SourceMeter 5)": f32[]
  "Current Waveform (SourceMeter 5)": f32[]
  "VISA resource name out_2": "Instr"
  "VISA resource name out_3": "Instr"
  "VISA resource name out_4": "Instr"
  "VISA resource name out_5": "Instr"
  "session out": "Instr"
  "session out_2": "Instr"
  "finished ramping 1": bool
  "finished ramping 2": bool
  "finsihed ramping 3": bool
  "finished ramping 4": bool
  "finished ramping 5": bool
  "Output Voltage": string
  "Output Current": string
  "session out_3": "Instr"
  "Ch-1 Output Voltage": string
  "Ch-1 Output Current": string
  "Ch-2 Output Voltage": string
  "Ch-2 Output Current": string
  "Ch-3 Output Voltage": string
  "Ch-3 Output Current": string
  "CH-16 Resistance": string
  "CH-17 Resistance": string
  "CH-18 Resistance": string
  "CH-19 Resistance": string
  "CH-20 Resistance": string
  "VISA resource name out": "Instr"
  "FILE PATH": path
  "Channel 1": bool
  "Channel 2": bool
  "Channel 3": bool
  "Channel 4": bool
  "Channel 5": bool
  "Channel 6": bool
  "Channel 7": bool
  "Channel 8": bool
  "session out_4": "Instr"
  "Ch1 Output Voltage": f64
  "Ch1 Output Current": f64
  "Ch2 Output Voltage": f64
  "Ch2 Output Current": f64
  "Ch3 Output Voltage": f64
  "Ch3 Output Current": f64
  "Ch7 Output Voltage": f64
  "Ch7 Output Current": f64
  "Ch8 Output Voltage": f64
  "Ch8 Output Current": f64
  "Ch4 Output Voltage": f64
  "Ch4 Output Current": f64
  "Ch5 Output Voltage": f64
  "Ch5 Output Current": f64
  "Ch6 Output Voltage": f64
  "Ch6 Output Current": f64
uses:
  NI::VISA::Close (Instr).gvi
  Keithley 24XX::Initialize.gvi
  Keithley 24XX::Configure Measurement.gvi
  NI::VISA::Write (Instr, String).gvi
  NI::G Core::Error::Is Error.gvi
  NI::VISA::Configure Serial Port (Instr).gvi
  NI::VISA::Open (Instr).gvi
  Keithley 24XX::Configure Output.gvi
  Keithley 24XX::Enable Output.gvi
  Keithley 24XX::Read (Multiple Points).gvi
  NI::VISA::Read (Instr, String).gvi
diagram:
  case ($"Sourcemeter 1 ON") {
    frame False, Default {
      w1 = ""
    }
    frame True {
      w1 = "GPIB0::24::INSTR"
    }
  }
  call "Close (Instr).gvi"(session in=w1) -> (error out=w2)
  call "Initialize.gvi"(VISA resource name=w1, error in=w2) -> (VISA resource name out=w3, error out=w4)
  call "Configure Measurement.gvi"(VISA resource name=w3, error in=w4, function="Volts"(0)) -> (VISA resource name out=w5, error out=w6)
  call "Configure Measurement.gvi"(VISA resource name=w5, error in=w6, function="Current"(1)) -> (VISA resource name out=w7, error out=w8)
  call "Write (Instr, String).gvi"(session in=w7, error in=w8, write buffer=":FUNC:OFF 'RES'") -> (error out=w9)
  call "Is Error.gvi"(error in=w9) -> (error?=w10)
  case ($"Sourcemeter 1 ON") {
    frame False, Default {
      w11 = FALSE
    }
    frame True {
      w11 = w10
    }
  }
  case ($"Sourcemeter 2 ON") {
    frame False, Default {
      w12 = ""
    }
    frame True {
      w12 = "GPIB0::24::INSTR"
    }
  }
  call "Close (Instr).gvi"(session in=w12) -> (error out=w13)
  call "Initialize.gvi"(VISA resource name=w12, error in=w13) -> (VISA resource name out=w14, error out=w15)
  call "Configure Measurement.gvi"(VISA resource name=w14, error in=w15, function="Volts"(0)) -> (VISA resource name out=w16, error out=w17)
  call "Configure Measurement.gvi"(VISA resource name=w16, error in=w17, function="Current"(1)) -> (VISA resource name out=w18, error out=w19)
  call "Write (Instr, String).gvi"(session in=w18, error in=w19, write buffer=":FUNC:OFF 'RES'") -> (error out=w20)
  call "Is Error.gvi"(error in=w20) -> (error?=w21)
  case ($"Sourcemeter 2 ON") {
    frame False, Default {
      w22 = FALSE
    }
    frame True {
      w22 = w21
    }
  }
  case ($"Sourcemeter 3 ON") {
    frame False, Default {
      w23 = ""
    }
    frame True {
      w23 = "GPIB0::18::INSTR"
    }
  }
  call "Close (Instr).gvi"(session in=w23) -> (error out=w24)
  call "Initialize.gvi"(VISA resource name=w23, error in=w24) -> (VISA resource name out=w25, error out=w26)
  call "Configure Measurement.gvi"(VISA resource name=w25, error in=w26, function="Volts"(0)) -> (VISA resource name out=w27, error out=w28)
  call "Configure Measurement.gvi"(VISA resource name=w27, error in=w28, function="Current"(1)) -> (VISA resource name out=w29, error out=w30)
  call "Write (Instr, String).gvi"(session in=w29, error in=w30, write buffer=":FUNC:OFF 'RES'") -> (error out=w31)
  call "Is Error.gvi"(error in=w31) -> (error?=w32)
  case ($"Sourcemeter 3 ON") {
    frame False, Default {
      w33 = FALSE
    }
    frame True {
      w33 = w32
    }
  }
  case ($"Sourcemeter 4 ON") {
    frame False, Default {
      w34 = ""
    }
    frame True {
      w34 = "GPIB1::24::INSTR"
    }
  }
  call "Close (Instr).gvi"(session in=w34) -> (error out=w35)
  call "Initialize.gvi"(VISA resource name=w34, error in=w35) -> (VISA resource name out=w36, error out=w37)
  call "Configure Measurement.gvi"(VISA resource name=w36, error in=w37, function="Volts"(0)) -> (VISA resource name out=w38, error out=w39)
  call "Configure Measurement.gvi"(VISA resource name=w38, error in=w39, function="Current"(1)) -> (VISA resource name out=w40, error out=w41)
  call "Write (Instr, String).gvi"(session in=w40, error in=w41, write buffer=":FUNC:OFF 'RES'") -> (error out=w42)
  call "Is Error.gvi"(error in=w42) -> (error?=w43)
  case ($"Sourcemeter 4 ON") {
    frame False, Default {
      w44 = FALSE
    }
    frame True {
      w44 = w43
    }
  }
  case ($"Sourcemeter 5 ON") {
    frame False, Default {
      w45 = ""
    }
    frame True {
      w45 = "GPIB2::24::INSTR"
    }
  }
  call "Close (Instr).gvi"(session in=w45) -> (error out=w46)
  call "Initialize.gvi"(VISA resource name=w45, error in=w46) -> (VISA resource name out=w47, error out=w48)
  call "Configure Measurement.gvi"(VISA resource name=w47, error in=w48, function="Volts"(0)) -> (VISA resource name out=w49, error out=w50)
  call "Configure Measurement.gvi"(VISA resource name=w49, error in=w50, function="Current"(1)) -> (VISA resource name out=w51, error out=w52)
  call "Write (Instr, String).gvi"(session in=w51, error in=w52, write buffer=":FUNC:OFF 'RES'") -> (error out=w53)
  call "Is Error.gvi"(error in=w53) -> (error?=w54)
  case ($"Sourcemeter 5 ON") {
    frame False, Default {
      w55 = FALSE
    }
    frame True {
      w55 = w54
    }
  }
  case ($"Photek ON") {
    frame False, Default {
      w56 = ""
    }
    frame True {
      w56 = "COM3"
    }
  }
  call "Close (Instr).gvi"(session in=w56) -> (error out=w57)
  call "Configure Serial Port (Instr).gvi"(stop bits="1.0"(10), session in=w56, error in=w57, baud rate=57600, parity="None"(0), timeout=2000, termination char=0xD, enable termination char=TRUE) -> (session out=w58, error out=w59)
  call "Open (Instr).gvi"(resource name=w58, error in=w59) -> (session out=w60, error out=w61)
  call "Is Error.gvi"(error in=w61) -> (error?=w62)
  case ($"Photek ON") {
    frame False, Default {
      w63 = FALSE
    }
    frame True {
      w63 = w62
    }
  }
  case ($"LV-PSU ON") {
    frame False, Default {
      w64 = ""
    }
    frame True {
      w64 = "GPIB1::1::INSTR"
    }
  }
  call "Close (Instr).gvi"(session in=w64) -> (error out=w65)
  call "Open (Instr).gvi"(resource name=w64, error in=w65) -> (session out=w66, error out=w67)
  call "Write (Instr, String).gvi"(session in=w66, error in=w67, write buffer="Outp 1") -> (session out=w68, error out=w69)
  call "Is Error.gvi"(error in=w69) -> (error?=w70)
  case ($"LV-PSU ON") {
    frame False, Default {
      w71 = FALSE
    }
    frame True {
      w71 = w70
    }
  }
  case ($"DMM ON") {
    frame False, Default {
      w72 = ""
    }
    frame True {
      w72 = "TCPIP::192.168.133.163::1394::SOCKET"
    }
  }
  call "Open (Instr).gvi"(resource name=w72) -> (session out=w73, error out=w74)
  Property Node[IgnoreErrorsInsideNode=True](instance in=w73, "ASRL GPIB TCP USB VXI IO Prot"="Serial-TCPIP-USB/488 Strings"(4), error in=w74) -> (error out=w75, instance out=w76)
  Concatenate Strings("FORM:ELEM READ", "\n") -> w77
  call "Write (Instr, String).gvi"(session in=w76, error in=w75, write buffer=w77) -> (session out=w78, error out=w79)
  call "Is Error.gvi"(error in=w79) -> (error?=w80)
  case ($"DMM ON") {
    frame False, Default {
      w81 = FALSE
    }
    frame True {
      w81 = w80
    }
  }
  case ($"CAEN ON") {
    frame False, Default {
      w82 = ""
    }
    frame True {
      w82 = "COM7"
    }
  }
  call "Close (Instr).gvi"(session in=w82) -> (error out=w83)
  call "Open (Instr).gvi"(resource name=w82, error in=w83) -> (session out=w84, error out=w85)
  Concatenate Strings("$BD:0,CMD:SET,CH:0,PAR:VSET,VAL:", $"voltage 1") -> w86
  Concatenate Strings(w86, "\n") -> w87
  call "Write (Instr, String).gvi"(session in=w84, error in=w85, write buffer=w87) -> (session out=w88, error out=w89)
  call "Is Error.gvi"(error in=w89) -> (error?=w90)
  case ($"Channel 1 ON") {
    frame False, Default {
      w91 = FALSE
    }
    frame True {
      w91 = w90
    }
  }
  Concatenate Strings("$BD:0,CMD:SET,CH:1,PAR:VSET,VAL:", $"voltage 2") -> w92
  Concatenate Strings(w92, "\n") -> w93
  call "Write (Instr, String).gvi"(session in=w88, write buffer=w93) -> (session out=w94, error out=w95)
  call "Is Error.gvi"(error in=w95) -> (error?=w96)
  case ($"Channel 2 ON") {
    frame False, Default {
      w97 = FALSE
    }
    frame True {
      w97 = w96
    }
  }
  Concatenate Strings("$BD:0,CMD:SET,CH:2,PAR:VSET,VAL:", $"voltage 3") -> w98
  Concatenate Strings(w98, "\n") -> w99
  call "Write (Instr, String).gvi"(session in=w94, write buffer=w99) -> (session out=w100, error out=w101)
  call "Is Error.gvi"(error in=w101) -> (error?=w102)
  case ($"Channel 3 ON") {
    frame False, Default {
      w103 = FALSE
    }
    frame True {
      w103 = w102
    }
  }
  Concatenate Strings("$BD:0,CMD:SET,CH:3,PAR:VSET,VAL:", $"voltage 4") -> w104
  Concatenate Strings(w104, "\n") -> w105
  call "Write (Instr, String).gvi"(session in=w100, write buffer=w105) -> (session out=w106, error out=w107)
  call "Is Error.gvi"(error in=w107) -> (error?=w108)
  case ($"Channel 4 ON") {
    frame False, Default {
      w109 = FALSE
    }
    frame True {
      w109 = w108
    }
  }
  Concatenate Strings("$BD:0,CMD:SET,CH:4,PAR:VSET,VAL:", $"voltage 5") -> w110
  Concatenate Strings(w110, "\n") -> w111
  call "Write (Instr, String).gvi"(session in=w106, write buffer=w111) -> (session out=w112, error out=w113)
  Concatenate Strings("$BD:0,CMD:SET,CH:5,PAR:VSET,VAL:", $"voltage 6") -> w114
  Concatenate Strings(w114, "\n") -> w115
  call "Write (Instr, String).gvi"(session in=w112, write buffer=w115) -> (session out=w116, error out=w117)
  call "Is Error.gvi"(error in=w117) -> (error?=w118)
  case ($"Channel 6 ON") {
    frame False, Default {
      w119 = FALSE
    }
    frame True {
      w119 = w118
    }
  }
  Concatenate Strings("$BD:0,CMD:SET,CH:6,PAR:VSET,VAL:", $"voltage 7") -> w120
  Concatenate Strings(w120, "\n") -> w121
  call "Write (Instr, String).gvi"(session in=w116, write buffer=w121) -> (session out=w122, error out=w123)
  call "Is Error.gvi"(error in=w123) -> (error?=w124)
  case ($"Channel 7 ON") {
    frame False, Default {
      w125 = FALSE
    }
    frame True {
      w125 = w124
    }
  }
  call "Is Error.gvi"(error in=w113) -> (error?=w126)
  case ($"Channel 5 ON") {
    frame False, Default {
      w127 = FALSE
    }
    frame True {
      w127 = w126
    }
  }
  Concatenate Strings("$BD:0,CMD:SET,CH:7,PAR:VSET,VAL:", $"voltage 8") -> w128
  Concatenate Strings(w128, "\n") -> w129
  call "Write (Instr, String).gvi"(session in=w122, write buffer=w129) -> (session out=w130, error out=w131)
  call "Is Error.gvi"(error in=w131) -> (error?=w132)
  case ($"Channel 8 ON") {
    frame False, Default {
      w133 = FALSE
    }
    frame True {
      w133 = w132
    }
  }
  Logical Or(w11, w22, w33, w44, w55, w63, w71, w81, w91, w97, w103, w109, w127, w119, w125, w133) -> w134
  Not(x=w134) -> w135
  $"ALL INSTRUMENTS" <- w135
  $"VISA resource name out" <- w7
  Not(x=w10) -> w136
  Logical And($"Sourcemeter 1 ON", w136) -> w137
  $"Sourcemeter 1" <- w137
  Not(x=w21) -> w138
  Logical And($"Sourcemeter 2 ON", w138) -> w139
  $"Sourcemeter 2" <- w139
  $"VISA resource name out_2" <- w18
  Not(x=w32) -> w140
  Logical And($"Sourcemeter 3 ON", w140) -> w141
  $"Sourcemeter 3" <- w141
  $"VISA resource name out_3" <- w29
  Not(x=w43) -> w142
  Logical And($"Sourcemeter 4 ON", w142) -> w143
  $"Sourcemeter 4" <- w143
  $"VISA resource name out_4" <- w40
  $"VISA resource name out_5" <- w51
  Not(x=w54) -> w144
  Logical And($"Sourcemeter 5 ON", w144) -> w145
  $"Sourcemeter 5" <- w145
  Not(x=w62) -> w146
  Logical And($"Photek ON", w146) -> w147
  $Photek <- w147
  $"session out" <- w60
  $"session out_2" <- w68
  while {
    Logical And($"RAMP UP", w135) -> w148
    stop if w148
  }
  case (w148) {
    frame False, Default {
      w150 = "If instruments ready, press ramp up! If instruments not ready try executing again."
      $"Present State" <- w150
      w149 = FALSE
    }
    frame True {
      case ($"LV-PSU") {
        frame False, Default {
          w151 = TRUE
        }
        frame True {
          Concatenate Strings(",", $"Ch-2 Voltage") -> w152
          Concatenate Strings(",", $"Ch-3 Voltage") -> w153
          Concatenate Strings(w152, w153) -> w154
          Concatenate Strings("APP:VOLT ", $"Ch-1 Voltage") -> w155
          Concatenate Strings(w155, w154) -> w156
          call "Write (Instr, String).gvi"(session in=$"session out_2", write buffer=w156) -> (error out=w157)
          call "Is Error.gvi"(error in=w157) -> (error?=w158)
          Not(x=w158) -> w151
        }
      }
      w159 = $"Compliance Level 1"
      # Ramp up mechanism
      w160 = $"Maximum 1"
      w161 = $"Ramp Up Step Width"
      case ($"Sourcemeter 1") {
        frame False, Default {
          w162 = TRUE
        }
        frame True {
          s1 = 0  # shift register
          while {
            Wait(time to wait=$"Ramp Up Delay")
            Add(s1, w161) -> w163
            call "Configure Output.gvi"(VISA resource name=$"VISA resource name out", output level=w163, compliance level=w159, source mode="Voltage"(0)) -> (VISA resource name out=w164, error out=w165)
            call "Enable Output.gvi"(VISA resource name=w164, error in=w165, enable output=TRUE) -> (VISA resource name out=w166, error out=w167)
            call "Read (Multiple Points).gvi"(output mode="list"(0), VISA resource name=w166, error in=w167) -> (VISA resource name out=w168, error out=w169, current=w170, voltage=w171)
            $"Voltage Waveform (SourceMeter 1)" <- w171
            call "Enable Output.gvi"(VISA resource name=w168, error in=w169, enable output=TRUE) -> (VISA resource name out=w172, error out=w173)
            $"Current Waveform (SourceMeter 1)" <- w170
            Subtract(x=w160, y=w161) -> w174
            Is Less(x=w163, y=w174) -> w175
            Not(x=TRUE) -> w176
            Logical Or(w175, w176) -> w162
            $"finished ramping 1" <- w162
            next s1 = w163
            stop if w162
          }
        }
      }
      w177 = $"Compliance Level 2"
      w178 = $"Maximum 2"
      case ($"Sourcemeter 2") {
        frame False, Default {
          w179 = TRUE
        }
        frame True {
          s2 = 0  # shift register
          while {
            Wait(time to wait=$"Ramp Up Delay")
            Add(s2, w161) -> w180
            call "Configure Output.gvi"(VISA resource name=$"VISA resource name out_2", output level=w180, compliance level=w177, source mode="Voltage"(0)) -> (VISA resource name out=w181, error out=w182)
            call "Enable Output.gvi"(VISA resource name=w181, error in=w182, enable output=TRUE) -> (VISA resource name out=w183, error out=w184)
            call "Read (Multiple Points).gvi"(output mode="list"(0), VISA resource name=w183, error in=w184) -> (VISA resource name out=w185, error out=w186, current=w187, voltage=w188)
            $"Voltage Waveform (SourceMeter 2)" <- w188
            call "Enable Output.gvi"(VISA resource name=w185, error in=w186, enable output=TRUE) -> (VISA resource name out=w189, error out=w190)
            $"Current Waveform (SourceMeter 2)" <- w187
            Subtract(x=w178, y=w161) -> w191
            Is Less(x=w180, y=w191) -> w192
            Not(x=TRUE) -> w193
            Logical Or(w192, w193) -> w179
            $"finished ramping 2" <- w179
            next s2 = w180
            stop if w179
          }
        }
      }
      w194 = $"Compliance Level 3"
      w195 = $"Maximum 3"
      case ($"Sourcemeter 3") {
        frame False, Default {
          w196 = TRUE
        }
        frame True {
          s3 = 0  # shift register
          while {
            Wait(time to wait=$"Ramp Up Delay")
            Add(s3, w161) -> w197
            call "Configure Output.gvi"(VISA resource name=$"VISA resource name out_3", output level=w197, compliance level=w194, source mode="Voltage"(0)) -> (VISA resource name out=w198, error out=w199)
            call "Enable Output.gvi"(VISA resource name=w198, error in=w199, enable output=TRUE) -> (VISA resource name out=w200, error out=w201)
            call "Read (Multiple Points).gvi"(output mode="list"(0), VISA resource name=w200, error in=w201) -> (VISA resource name out=w202, error out=w203, current=w204, voltage=w205)
            $"Voltage Waveform (SourceMeter 3)" <- w205
            call "Enable Output.gvi"(VISA resource name=w202, error in=w203, enable output=TRUE) -> (VISA resource name out=w206, error out=w207)
            $"Current Waveform (SourceMeter 3)" <- w204
            Subtract(x=w195, y=w161) -> w208
            Is Less(x=w197, y=w208) -> w209
            Not(x=TRUE) -> w210
            Logical Or(w209, w210) -> w196
            $"finsihed ramping 3" <- w196
            next s3 = w197
            stop if w196
          }
        }
      }
      w211 = $"Compliance Level 4"
      w212 = $"Maximum 4"
      case ($"Sourcemeter 4") {
        frame False, Default {
          w213 = TRUE
        }
        frame True {
          s4 = 0  # shift register
          while {
            Wait(time to wait=$"Ramp Up Delay")
            Add(s4, w161) -> w214
            call "Configure Output.gvi"(VISA resource name=$"VISA resource name out_4", output level=w214, compliance level=w211, source mode="Voltage"(0)) -> (VISA resource name out=w215, error out=w216)
            call "Enable Output.gvi"(VISA resource name=w215, error in=w216, enable output=TRUE) -> (VISA resource name out=w217, error out=w218)
            call "Read (Multiple Points).gvi"(output mode="list"(0), VISA resource name=w217, error in=w218) -> (VISA resource name out=w219, error out=w220, current=w221, voltage=w222)
            $"Voltage Waveform (SourceMeter 4)" <- w222
            call "Enable Output.gvi"(VISA resource name=w219, error in=w220, enable output=TRUE) -> (VISA resource name out=w223, error out=w224)
            $"Current Waveform (SourceMeter 4)" <- w221
            Subtract(x=w212, y=w161) -> w225
            Is Less(x=w214, y=w225) -> w226
            Not(x=TRUE) -> w227
            Logical Or(w226, w227) -> w213
            $"finished ramping 4" <- w213
            next s4 = w214
            stop if w213
          }
        }
      }
      w228 = $"Compliance Level 5"
      w229 = $"Maximum 5"
      case ($"Sourcemeter 5") {
        frame False, Default {
          w230 = TRUE
        }
        frame True {
          s5 = 0  # shift register
          while {
            Wait(time to wait=$"Ramp Up Delay")
            Add(s5, w161) -> w231
            call "Configure Output.gvi"(VISA resource name=$"VISA resource name out_5", output level=w231, compliance level=w228, source mode="Voltage"(0)) -> (VISA resource name out=w232, error out=w233)
            call "Enable Output.gvi"(VISA resource name=w232, error in=w233, enable output=TRUE) -> (VISA resource name out=w234, error out=w235)
            call "Read (Multiple Points).gvi"(output mode="list"(0), VISA resource name=w234, error in=w235) -> (VISA resource name out=w236, error out=w237, current=w238, voltage=w239)
            $"Voltage Waveform (SourceMeter 5)" <- w239
            call "Enable Output.gvi"(VISA resource name=w236, error in=w237, enable output=TRUE) -> (VISA resource name out=w240, error out=w241)
            $"Current Waveform (SourceMeter 5)" <- w238
            Subtract(x=w229, y=w161) -> w242
            Is Less(x=w231, y=w242) -> w243
            Not(x=TRUE) -> w244
            Logical Or(w243, w244) -> w230
            $"finished ramping 5" <- w230
            next s5 = w231
            stop if w230
          }
        }
      }
      case ($Photek) {
        frame False, Default {
          w245 = TRUE
        }
        frame True {
          Concatenate Strings("setchannel1,", $Voltage) -> w246
          Concatenate Strings(w246, "\n") -> w247
          call "Write (Instr, String).gvi"(session in=$"session out", write buffer=w247) -> (session out=w248, error out=w249)
          Concatenate Strings("power1", "\n") -> w250
          call "Write (Instr, String).gvi"(session in=w248, error in=w249, write buffer=w250) -> (error out=w251)
          call "Is Error.gvi"(error in=w251) -> (error?=w252)
          Not(x=w252) -> w245
        }
      }
      case ($"Channel 1") {
        frame False, Default {
          w253 = TRUE
        }
        frame True {
          Concatenate Strings("$BD:0,CMD:SET,CH:0,PAR:ON", "\n") -> w254
          call "Write (Instr, String).gvi"(session in=$"session out_4", write buffer=w254) -> (error out=w255)
          call "Is Error.gvi"(error in=w255) -> (error?=w256)
          Not(x=w256) -> w253
        }
      }
      case ($"Channel 2") {
        frame False, Default {
          w257 = TRUE
        }
        frame True {
          Concatenate Strings("$BD:0,CMD:SET,CH:1,PAR:ON", "\n") -> w258
          call "Write (Instr, String).gvi"(session in=$"session out_4", write buffer=w258) -> (error out=w259)
          call "Is Error.gvi"(error in=w259) -> (error?=w260)
          Not(x=w260) -> w257
        }
      }
      case ($"Channel 3") {
        frame False, Default {
          w261 = TRUE
        }
        frame True {
          Concatenate Strings("$BD:0,CMD:SET,CH:2,PAR:ON", "\n") -> w262
          call "Write (Instr, String).gvi"(session in=$"session out_4", write buffer=w262) -> (error out=w263)
          call "Is Error.gvi"(error in=w263) -> (error?=w264)
          Not(x=w264) -> w261
        }
      }
      case ($"Channel 4") {
        frame False, Default {
          w265 = TRUE
        }
        frame True {
          Concatenate Strings("$BD:0,CMD:SET,CH:3,PAR:ON", "\n") -> w266
          call "Write (Instr, String).gvi"(session in=$"session out_4", write buffer=w266) -> (error out=w267)
          call "Is Error.gvi"(error in=w267) -> (error?=w268)
          Not(x=w268) -> w265
        }
      }
      case ($"Channel 5") {
        frame False, Default {
          w269 = TRUE
        }
        frame True {
          Concatenate Strings("$BD:0,CMD:SET,CH:4,PAR:ON", "\n") -> w270
          call "Write (Instr, String).gvi"(session in=$"session out_4", write buffer=w270) -> (error out=w271)
          call "Is Error.gvi"(error in=w271) -> (error?=w272)
          Not(x=w272) -> w269
        }
      }
      case ($"Channel 6") {
        frame False, Default {
          w273 = TRUE
        }
        frame True {
          Concatenate Strings("$BD:0,CMD:SET,CH:5,PAR:ON", "\n") -> w274
          call "Write (Instr, String).gvi"(session in=$"session out_4", write buffer=w274) -> (error out=w275)
          call "Is Error.gvi"(error in=w275) -> (error?=w276)
          Not(x=w276) -> w273
        }
      }
      case ($"Channel 7") {
        frame False, Default {
          w277 = TRUE
        }
        frame True {
          Concatenate Strings("$BD:0,CMD:SET,CH:6,PAR:ON", "\n") -> w278
          call "Write (Instr, String).gvi"(session in=$"session out_4", write buffer=w278) -> (error out=w279)
          call "Is Error.gvi"(error in=w279) -> (error?=w280)
          Not(x=w280) -> w277
        }
      }
      case ($"Channel 8") {
        frame False, Default {
          w281 = TRUE
        }
        frame True {
          Concatenate Strings("$BD:0,CMD:SET,CH:7,PAR:ON", "\n") -> w282
          call "Write (Instr, String).gvi"(session in=$"session out_4", write buffer=w282) -> (error out=w283)
          call "Is Error.gvi"(error in=w283) -> (error?=w284)
          Not(x=w284) -> w281
        }
      }
      Logical And(w162, w179, w196, w213, w230, w245, w151, w253, w257, w261, w265, w269, w273, w277, w281) -> w149
    }
  }
  Not(x=w149) -> w285
  $"RAMP UP" <- w285
  Not(x=w70) -> w286
  Logical And($"LV-PSU ON", w286) -> w287
  $"LV-PSU" <- w287
  Not(x=w80) -> w288
  Logical And($"DMM ON", w288) -> w289
  $DMM <- w289
  $"session out_3" <- w78
  Not(x=w90) -> w290
  Logical And($"Channel 1 ON", w290) -> w291
  $"Channel 1" <- w291
  Not(x=w96) -> w292
  Logical And($"Channel 2 ON", w292) -> w293
  $"Channel 2" <- w293
  Not(x=w102) -> w294
  Logical And($"Channel 3 ON", w294) -> w295
  $"Channel 3" <- w295
  Not(x=w108) -> w296
  Logical And($"Channel 4 ON", w296) -> w297
  $"Channel 4" <- w297
  Not(x=w126) -> w298
  Logical And($"Channel 5 ON", w298) -> w299
  $"Channel 5" <- w299
  Not(x=w118) -> w300
  Logical And($"Channel 6 ON", w300) -> w301
  $"Channel 6" <- w301
  $"session out_4" <- w130
  Not(x=w124) -> w302
  Logical And($"Channel 7 ON", w302) -> w303
  $"Channel 7" <- w303
  Not(x=w132) -> w304
  Logical And($"Channel 8 ON", w304) -> w305
  $"Channel 8" <- w305
  case (w149) {
    frame False, Default {
      w306 = FALSE
    }
    frame True {
      while {
        s6 = path ""  # shift register
        while (iteration -> i1) {
          Wait(time to wait=1000)
          Get Current Time() -> (current time=w307)
          Time Stamp Subtract(x=w307, y=2000-01-01T06:00:00Z) -> w308
          case ($"Channel 1") {
            frame False, Default {
              w309 = 0
              w310 = 0
              w311 = $"session out_4"
            }
            frame True {
              Concatenate Strings("$BD:0,CMD:MON,CH:0,PAR:VMON", "\n") -> w312
              call "Write (Instr, String).gvi"(session in=$"session out_4", write buffer=w312) -> (session out=w313, error out=w314)
              call "Read (Instr, String).gvi"(session in=w313, error in=w314, byte count=26) -> (session out=w315, error out=w316, read buffer=w317)
              Scan From String(formatString="#BD:00,CMD:OK,VAL:%f", inputString=w317, startLoc=0) -> (out0=w309)
              $"Ch1 Output Voltage" <- w309
              Concatenate Strings("$BD:0,CMD:MON,CH:0,PAR:IMON", "\n") -> w318
              call "Write (Instr, String).gvi"(session in=w315, error in=w316, write buffer=w318) -> (session out=w319, error out=w320)
              call "Read (Instr, String).gvi"(session in=w319, error in=w320, byte count=27) -> (session out=w311, read buffer=w321)
              Scan From String(formatString="#BD:00,CMD:OK,VAL:%f", inputString=w321, startLoc=0) -> (out0=w310)
              $"Ch1 Output Current" <- w310
            }
          }
          case ($"Channel 2") {
            frame False, Default {
              w322 = 0
              w323 = 0
              w324 = w311
            }
            frame True {
              Concatenate Strings("$BD:0,CMD:MON,CH:1,PAR:VMON", "\n") -> w325
              call "Write (Instr, String).gvi"(session in=w311, write buffer=w325) -> (session out=w326, error out=w327)
              call "Read (Instr, String).gvi"(session in=w326, error in=w327, byte count=26) -> (session out=w328, error out=w329, read buffer=w330)
              Scan From String(formatString="#BD:00,CMD:OK,VAL:%f", inputString=w330, startLoc=0) -> (out0=w322)
              $"Ch2 Output Voltage" <- w322
              Concatenate Strings("$BD:0,CMD:MON,CH:1,PAR:IMON", "\n") -> w331
              call "Write (Instr, String).gvi"(session in=w328, error in=w329, write buffer=w331) -> (session out=w332, error out=w333)
              call "Read (Instr, String).gvi"(session in=w332, error in=w333, byte count=27) -> (session out=w324, read buffer=w334)
              Scan From String(formatString="#BD:00,CMD:OK,VAL:%f", inputString=w334, startLoc=0) -> (out0=w323)
              $"Ch2 Output Current" <- w323
            }
          }
          case ($"Channel 3") {
            frame False, Default {
              w335 = 0
              w336 = 0
              w337 = w324
            }
            frame True {
              Concatenate Strings("$BD:0,CMD:MON,CH:2,PAR:VMON", "\n") -> w338
              call "Write (Instr, String).gvi"(session in=w324, write buffer=w338) -> (session out=w339, error out=w340)
              call "Read (Instr, String).gvi"(session in=w339, error in=w340, byte count=26) -> (session out=w341, error out=w342, read buffer=w343)
              Scan From String(formatString="#BD:00,CMD:OK,VAL:%f", inputString=w343, startLoc=0) -> (out0=w335)
              $"Ch3 Output Voltage" <- w335
              Concatenate Strings("$BD:0,CMD:MON,CH:2,PAR:IMON", "\n") -> w344
              call "Write (Instr, String).gvi"(session in=w341, error in=w342, write buffer=w344) -> (session out=w345, error out=w346)
              call "Read (Instr, String).gvi"(session in=w345, error in=w346, byte count=27) -> (session out=w337, read buffer=w347)
              Scan From String(formatString="#BD:00,CMD:OK,VAL:%f", inputString=w347, startLoc=0) -> (out0=w336)
              $"Ch3 Output Current" <- w336
            }
          }
          case ($"Channel 4") {
            frame False, Default {
              w348 = 0
              w349 = 0
              w350 = w337
            }
            frame True {
              Concatenate Strings("$BD:0,CMD:MON,CH:3,PAR:VMON", "\n") -> w351
              call "Write (Instr, String).gvi"(session in=w337, write buffer=w351) -> (session out=w352, error out=w353)
              call "Read (Instr, String).gvi"(session in=w352, error in=w353, byte count=26) -> (session out=w354, error out=w355, read buffer=w356)
              Scan From String(formatString="#BD:00,CMD:OK,VAL:%f", inputString=w356, startLoc=0) -> (out0=w348)
              $"Ch4 Output Voltage" <- w348
              Concatenate Strings("$BD:0,CMD:MON,CH:0,PAR:IMON", "\n") -> w357
              call "Write (Instr, String).gvi"(session in=w354, error in=w355, write buffer=w357) -> (session out=w358, error out=w359)
              call "Read (Instr, String).gvi"(session in=w358, error in=w359, byte count=27) -> (session out=w350, read buffer=w360)
              Scan From String(formatString="#BD:00,CMD:OK,VAL:%f", inputString=w360, startLoc=0) -> (out0=w349)
              $"Ch4 Output Current" <- w349
            }
          }
          case ($"Channel 5") {
            frame False, Default {
              w361 = 0
              w362 = 0
              w363 = w350
            }
            frame True {
              Concatenate Strings("$BD:0,CMD:MON,CH:4,PAR:VMON", "\n") -> w364
              call "Write (Instr, String).gvi"(session in=w350, write buffer=w364) -> (session out=w365, error out=w366)
              call "Read (Instr, String).gvi"(session in=w365, error in=w366, byte count=26) -> (session out=w367, error out=w368, read buffer=w369)
              Scan From String(formatString="#BD:00,CMD:OK,VAL:%f", inputString=w369, startLoc=0) -> (out0=w361)
              $"Ch5 Output Voltage" <- w361
              Concatenate Strings("$BD:0,CMD:MON,CH:4,PAR:IMON", "\n") -> w370
              call "Write (Instr, String).gvi"(session in=w367, error in=w368, write buffer=w370) -> (session out=w371, error out=w372)
              call "Read (Instr, String).gvi"(session in=w371, error in=w372, byte count=27) -> (session out=w363, read buffer=w373)
              Scan From String(formatString="#BD:00,CMD:OK,VAL:%f", inputString=w373, startLoc=0) -> (out0=w362)
              $"Ch5 Output Current" <- w362
            }
          }
          case ($"Channel 6") {
            frame False, Default {
              w374 = 0
              w375 = 0
              w376 = w363
            }
            frame True {
              Concatenate Strings("$BD:0,CMD:MON,CH:5,PAR:VMON", "\n") -> w377
              call "Write (Instr, String).gvi"(session in=w363, write buffer=w377) -> (session out=w378, error out=w379)
              call "Read (Instr, String).gvi"(session in=w378, error in=w379, byte count=26) -> (session out=w380, error out=w381, read buffer=w382)
              Scan From String(formatString="#BD:00,CMD:OK,VAL:%f", inputString=w382, startLoc=0) -> (out0=w374)
              $"Ch6 Output Voltage" <- w374
              Concatenate Strings("$BD:0,CMD:MON,CH:5,PAR:IMON", "\n") -> w383
              call "Write (Instr, String).gvi"(session in=w380, error in=w381, write buffer=w383) -> (session out=w384, error out=w385)
              call "Read (Instr, String).gvi"(session in=w384, error in=w385, byte count=27) -> (session out=w376, read buffer=w386)
              Scan From String(formatString="#BD:00,CMD:OK,VAL:%f", inputString=w386, startLoc=0) -> (out0=w375)
              $"Ch6 Output Current" <- w375
            }
          }
          case ($DMM) {
            frame False, Default {
              w387 = 0
              w388 = 0
              w389 = 0
              w390 = 0
              w391 = 0
            }
            frame True {
              case ($"CH-16 ON") {
                frame False, Default {
                  w392 = "0"
                  w393 = $"session out_3"
                }
                frame True {
                  Concatenate Strings("MEAS:RES? (@1", $"Channel 16 (J0)") -> w394
                  Concatenate Strings(w394, ")") -> w395
                  Concatenate Strings(w395, "\n") -> w396
                  call "Write (Instr, String).gvi"(session in=$"session out_3", write buffer=w396) -> (session out=w397)
                  call "Read (Instr, String).gvi"(session in=w397, byte count=16) -> (session out=w393, error out=w398, read buffer=w399)
                  call "Is Error.gvi"(error in=w398) -> (error?=w400)
                  case (w400) {
                    frame False, Default {
                      w392 = w399
                    }
                    frame True {
                      w392 = "-1"
                    }
                  }
                }
              }
              $"CH-16 Resistance" <- w392
              case ($"CH-17 ON") {
                frame False, Default {
                  w401 = w393
                  w402 = "0"
                }
                frame True {
                  Concatenate Strings("MEAS:RES? (@1", $"Channel 17 (J1)") -> w403
                  Concatenate Strings(w403, ")") -> w404
                  Concatenate Strings(w404, "\n") -> w405
                  call "Write (Instr, String).gvi"(session in=w393, write buffer=w405) -> (session out=w406)
                  call "Read (Instr, String).gvi"(session in=w406, byte count=16) -> (session out=w401, error out=w407, read buffer=w408)
                  call "Is Error.gvi"(error in=w407) -> (error?=w409)
                  case (w409) {
                    frame False, Default {
                      w402 = w408
                    }
                    frame True {
                      w402 = "-1"
                    }
                  }
                }
              }
              $"CH-17 Resistance" <- w402
              case ($"CH-18 ON") {
                frame False, Default {
                  w410 = w401
                  w411 = "0"
                }
                frame True {
                  Concatenate Strings("MEAS:RES? (@1", $"Channel 18 (J2)") -> w412
                  Concatenate Strings(w412, ")") -> w413
                  Concatenate Strings(w413, "\n") -> w414
                  call "Write (Instr, String).gvi"(session in=w401, write buffer=w414) -> (session out=w415)
                  call "Read (Instr, String).gvi"(session in=w415, byte count=16) -> (session out=w410, error out=w416, read buffer=w417)
                  call "Is Error.gvi"(error in=w416) -> (error?=w418)
                  case (w418) {
                    frame False, Default {
                      w411 = w417
                    }
                    frame True {
                      w411 = "-1"
                    }
                  }
                }
              }
              case ($"CH-19 ON") {
                frame False, Default {
                  w419 = w410
                  w420 = "0"
                }
                frame True {
                  Concatenate Strings("MEAS:RES? (@1", $"Channel 19 (J3)") -> w421
                  Concatenate Strings(w421, ")") -> w422
                  Concatenate Strings(w422, "\n") -> w423
                  call "Write (Instr, String).gvi"(session in=w410, write buffer=w423) -> (session out=w424)
                  call "Read (Instr, String).gvi"(session in=w424, byte count=16) -> (session out=w419, error out=w425, read buffer=w426)
                  call "Is Error.gvi"(error in=w425) -> (error?=w427)
                  case (w427) {
                    frame False, Default {
                      w420 = w426
                    }
                    frame True {
                      w420 = "-1"
                    }
                  }
                }
              }
              $"CH-19 Resistance" <- w420
              case ($"CH-20 ON") {
                frame False, Default {
                  w428 = "0"
                }
                frame True {
                  Concatenate Strings("MEAS:RES? (@1", $"Channel 20 (J4)") -> w429
                  Concatenate Strings(w429, ")") -> w430
                  Concatenate Strings(w430, "\n") -> w431
                  call "Write (Instr, String).gvi"(session in=w419, write buffer=w431) -> (session out=w432)
                  call "Read (Instr, String).gvi"(session in=w432, byte count=16) -> (error out=w433, read buffer=w434)
                  call "Is Error.gvi"(error in=w433) -> (error?=w435)
                  case (w435) {
                    frame False, Default {
                      w428 = w434
                    }
                    frame True {
                      w428 = "-1"
                    }
                  }
                }
              }
              $"CH-20 Resistance" <- w428
              $"CH-18 Resistance" <- w411
              Floating Point String To Number(string=w392) -> (number=w387)
              Floating Point String To Number(string=w402) -> (number=w388)
              Floating Point String To Number(string=w411) -> (number=w389)
              Floating Point String To Number(string=w420) -> (number=w390)
              Floating Point String To Number(string=w428) -> (number=w391)
            }
          }
          case ($"Channel 7") {
            frame False, Default {
              w436 = 0
              w437 = 0
              w438 = w376
            }
            frame True {
              Concatenate Strings("$BD:0,CMD:MON,CH:6,PAR:VMON", "\n") -> w439
              call "Write (Instr, String).gvi"(session in=w376, write buffer=w439) -> (session out=w440, error out=w441)
              call "Read (Instr, String).gvi"(session in=w440, error in=w441, byte count=26) -> (session out=w442, error out=w443, read buffer=w444)
              Scan From String(formatString="#BD:00,CMD:OK,VAL:%f", inputString=w444, startLoc=0) -> (out0=w436)
              $"Ch7 Output Voltage" <- w436
              Concatenate Strings("$BD:0,CMD:MON,CH:6,PAR:IMON", "\n") -> w445
              call "Write (Instr, String).gvi"(session in=w442, error in=w443, write buffer=w445) -> (session out=w446, error out=w447)
              call "Read (Instr, String).gvi"(session in=w446, error in=w447, byte count=27) -> (session out=w438, read buffer=w448)
              Scan From String(formatString="#BD:00,CMD:OK,VAL:%f", inputString=w448, startLoc=0) -> (out0=w437)
              $"Ch7 Output Current" <- w437
            }
          }
          case ($"Channel 8") {
            frame False, Default {
              w449 = 0
              w450 = 0
            }
            frame True {
              Concatenate Strings("$BD:0,CMD:MON,CH:7,PAR:VMON", "\n") -> w451
              call "Write (Instr, String).gvi"(session in=w438, write buffer=w451) -> (session out=w452, error out=w453)
              call "Read (Instr, String).gvi"(session in=w452, error in=w453, byte count=26) -> (session out=w454, error out=w455, read buffer=w456)
              Scan From String(formatString="#BD:00,CMD:OK,VAL:%f", inputString=w456, startLoc=0) -> (out0=w449)
              $"Ch8 Output Voltage" <- w449
              Concatenate Strings("$BD:0,CMD:MON,CH:7,PAR:IMON", "\n") -> w457
              call "Write (Instr, String).gvi"(session in=w454, error in=w455, write buffer=w457) -> (session out=w458, error out=w459)
              call "Read (Instr, String).gvi"(session in=w458, error in=w459, byte count=27) -> (read buffer=w460)
              Scan From String(formatString="#BD:00,CMD:OK,VAL:%f", inputString=w460, startLoc=0) -> (out0=w450)
              $"Ch8 Output Current" <- w450
            }
          }
          case ($"Sourcemeter 2") {
            frame False, Default {
              w461 = 0
              w462 = 0
            }
            frame True {
              call "Configure Output.gvi"(VISA resource name=$"VISA resource name out_2", output level=$"Maximum 2", compliance level=$"Compliance Level 2", source mode="Voltage"(0)) -> (VISA resource name out=w463, error out=w464)
              call "Enable Output.gvi"(VISA resource name=w463, error in=w464, enable output=TRUE) -> (VISA resource name out=w465, error out=w466)
              call "Read (Multiple Points).gvi"(output mode="list"(0), VISA resource name=w465, error in=w466) -> (current=w467, voltage=w468)
              $"Voltage Waveform (SourceMeter 2)" <- w468
              $"Current Waveform (SourceMeter 2)" <- w467
              Array Index(array=w468) -> (out0[0]=w461)
              Array Index(array=w467) -> (out0[0]=w462)
            }
          }
          case ($"Sourcemeter 3") {
            frame False, Default {
              w469 = 0
              w470 = 0
            }
            frame True {
              call "Configure Output.gvi"(VISA resource name=$"VISA resource name out_3", output level=$"Maximum 3", compliance level=$"Compliance Level 3", source mode="Voltage"(0)) -> (VISA resource name out=w471, error out=w472)
              call "Enable Output.gvi"(VISA resource name=w471, error in=w472, enable output=TRUE) -> (VISA resource name out=w473, error out=w474)
              call "Read (Multiple Points).gvi"(output mode="list"(0), VISA resource name=w473, error in=w474) -> (current=w475, voltage=w476)
              $"Voltage Waveform (SourceMeter 3)" <- w476
              $"Current Waveform (SourceMeter 3)" <- w475
              Array Index(array=w476) -> (out0[0]=w469)
              Array Index(array=w475) -> (out0[0]=w470)
            }
          }
          case ($"Sourcemeter 4") {
            frame False, Default {
              w477 = 0
              w478 = 0
            }
            frame True {
              call "Configure Output.gvi"(VISA resource name=$"VISA resource name out_4", output level=$"Maximum 4", compliance level=$"Compliance Level 4", source mode="Voltage"(0)) -> (VISA resource name out=w479, error out=w480)
              call "Enable Output.gvi"(VISA resource name=w479, error in=w480, enable output=TRUE) -> (VISA resource name out=w481, error out=w482)
              call "Read (Multiple Points).gvi"(output mode="list"(0), VISA resource name=w481, error in=w482) -> (current=w483, voltage=w484)
              $"Voltage Waveform (SourceMeter 4)" <- w484
              $"Current Waveform (SourceMeter 4)" <- w483
              Array Index(array=w484) -> (out0[0]=w477)
              Array Index(array=w483) -> (out0[0]=w478)
            }
          }
          # otsdaq readable Timestamp array
          case ($"Sourcemeter 1") {
            frame False, Default {
              w485 = 0
              w486 = 0
            }
            frame True {
              call "Configure Output.gvi"(VISA resource name=$"VISA resource name out", output level=$"Maximum 1", compliance level=$"Compliance Level 1", source mode="Voltage"(0)) -> (VISA resource name out=w487, error out=w488)
              call "Enable Output.gvi"(VISA resource name=w487, error in=w488, enable output=TRUE) -> (VISA resource name out=w489, error out=w490)
              call "Read (Multiple Points).gvi"(VISA resource name=w489, error in=w490) -> (current=w491, voltage=w492)
              $"Voltage Waveform (SourceMeter 1)" <- w492
              $"Current Waveform (SourceMeter 1)" <- w491
              Array Index(array=w492) -> (out0[0]=w485)
              Array Index(array=w491) -> (out0[0]=w486)
            }
          }
          case ($"Sourcemeter 5") {
            frame False, Default {
              w493 = 0
              w494 = 0
            }
            frame True {
              call "Configure Output.gvi"(VISA resource name=$"VISA resource name out_5", output level=$"Maximum 5", compliance level=$"Compliance Level 5", source mode="Voltage"(0)) -> (VISA resource name out=w495, error out=w496)
              call "Enable Output.gvi"(VISA resource name=w495, error in=w496, enable output=TRUE) -> (VISA resource name out=w497, error out=w498)
              call "Read (Multiple Points).gvi"(output mode="list"(0), VISA resource name=w497, error in=w498) -> (current=w499, voltage=w500)
              $"Voltage Waveform (SourceMeter 5)" <- w500
              $"Current Waveform (SourceMeter 5)" <- w499
              Array Index(array=w500) -> (out0[0]=w493)
              Array Index(array=w499) -> (out0[0]=w494)
            }
          }
          case ($Photek) {
            frame False, Default {
              w501 = 0
              w502 = 0
            }
            frame True {
              Concatenate Strings("getchannel1,1", "\n") -> w503
              call "Write (Instr, String).gvi"(session in=$"session out", write buffer=w503) -> (session out=w504, error out=w505)
              case (i1) {
                frame 0 {
                  call "Read (Instr, String).gvi"(session in=w504, error in=w505, byte count=100) -> (session out=w508, error out=w509)
                  call "Read (Instr, String).gvi"(session in=w508, error in=w509, byte count=100) -> (session out=w510, error out=w511)
                  case (TRUE) {
                    frame False, Default {
                      w506 = default
                      w512 = default
                      w513 = default
                    }
                    frame True {
                      call "Read (Instr, String).gvi"(session in=w510, error in=w511, byte count=100) -> (session out=w513, error out=w512, read buffer=w506)
                    }
                  }
                  call "Read (Instr, String).gvi"(session in=w513, error in=w512, byte count=100) -> (session out=w514, error out=w515)
                  Concatenate Strings("getchannel1,3", "\n") -> w516
                  call "Write (Instr, String).gvi"(session in=w514, error in=w515, write buffer=w516) -> (session out=w517, error out=w518)
                  call "Read (Instr, String).gvi"(session in=w517, error in=w518, byte count=100) -> (session out=w519, error out=w520, read buffer=w507)
                  call "Read (Instr, String).gvi"(session in=w519, error in=w520, byte count=100) -> (session out=w521, error out=w522)
                }
                frame 1, Default {
                  case (TRUE) {
                    frame False, Default {
                      w523 = default
                      w524 = default
                      w506 = default
                    }
                    frame True {
                      call "Read (Instr, String).gvi"(session in=w504, error in=w505, byte count=100) -> (session out=w523, error out=w524, read buffer=w506)
                    }
                  }
                  call "Read (Instr, String).gvi"(session in=w523, error in=w524, byte count=100) -> (session out=w525, error out=w526)
                  Concatenate Strings("getchannel1,3", "\n") -> w527
                  call "Write (Instr, String).gvi"(session in=w525, error in=w526, write buffer=w527) -> (session out=w528, error out=w529)
                  call "Read (Instr, String).gvi"(session in=w528, error in=w529, byte count=100) -> (session out=w530, error out=w531, read buffer=w507)
                  call "Read (Instr, String).gvi"(session in=w530, error in=w531, byte count=100) -> (session out=w532, error out=w533)
                }
              }
              Floating Point String To Number(string=w506) -> (number=w501)
              $"Output Voltage" <- w506
              Floating Point String To Number(string=w507) -> (number=w502)
              $"Output Current" <- w507
            }
          }
          case ($"LV-PSU") {
            frame False, Default {
              w534 = 0
              w535 = 0
              w536 = 0
              w537 = 0
              w538 = 0
              w539 = 0
            }
            frame True {
              call "Write (Instr, String).gvi"(session in=$"session out_2", write buffer="Appl ch1") -> (session out=w540, error out=w541)
              call "Write (Instr, String).gvi"(session in=w540, error in=w541, write buffer="FETC?") -> (session out=w542, error out=w543)
              call "Read (Instr, String).gvi"(session in=w542, error in=w543, byte count=8) -> (session out=w544, error out=w545, read buffer=w546)
              call "Write (Instr, String).gvi"(session in=w544, error in=w545, write buffer="FETC:CURR?") -> (session out=w547, error out=w548)
              call "Read (Instr, String).gvi"(session in=w547, error in=w548, byte count=8) -> (session out=w549, error out=w550, read buffer=w551)
              call "Write (Instr, String).gvi"(session in=w549, error in=w550, write buffer="Appl ch2") -> (session out=w552, error out=w553)
              call "Write (Instr, String).gvi"(session in=w552, error in=w553, write buffer="FETC?") -> (session out=w554, error out=w555)
              call "Read (Instr, String).gvi"(session in=w554, error in=w555, byte count=8) -> (session out=w556, error out=w557, read buffer=w558)
              call "Write (Instr, String).gvi"(session in=w556, error in=w557, write buffer="FETC:CURR?") -> (session out=w559, error out=w560)
              call "Read (Instr, String).gvi"(session in=w559, error in=w560, byte count=8) -> (session out=w561, error out=w562, read buffer=w563)
              call "Write (Instr, String).gvi"(session in=w561, error in=w562, write buffer="Appl ch3") -> (session out=w564, error out=w565)
              call "Write (Instr, String).gvi"(session in=w564, error in=w565, write buffer="FETC?") -> (session out=w566, error out=w567)
              call "Read (Instr, String).gvi"(session in=w566, error in=w567, byte count=8) -> (session out=w568, error out=w569, read buffer=w570)
              call "Write (Instr, String).gvi"(session in=w568, error in=w569, write buffer="FETC:CURR?") -> (session out=w571, error out=w572)
              call "Read (Instr, String).gvi"(session in=w571, error in=w572, byte count=8) -> (read buffer=w573)
              $"Ch-3 Output Current" <- w573
              $"Ch-1 Output Current" <- w551
              $"Ch-2 Output Current" <- w563
              $"Ch-3 Output Voltage" <- w570
              $"Ch-1 Output Voltage" <- w546
              $"Ch-2 Output Voltage" <- w558
              Floating Point String To Number(string=w546) -> (number=w534)
              Floating Point String To Number(string=w551) -> (number=w535)
              Floating Point String To Number(string=w558) -> (number=w536)
              Floating Point String To Number(string=w563) -> (number=w537)
              Floating Point String To Number(string=w570) -> (number=w538)
              Floating Point String To Number(string=w573) -> (number=w539)
            }
          }
          Build Array(w308, w485, w486, w461, w462, w469, w470, w477, w478, w493, w494, w501, w502, w534, w535, w536, w537, w538, w539, w387, w388, w389, w390, w391, w309, w310, w322, w323, w335, w336, w348, w349, w361, w362, w374, w375, w436, w437, w449, w450) -> w574
          Array To Spreadsheet String(array=w574, format string="%20.15f") -> (spreadsheet string=w575)
          case (i1) {
            frame 0 {
              Number To Fractional String(number=w308, precision (6)=3) -> (F-format string=w577)
              Concatenate Strings("lab_meas_unsync_", w577) -> w578
              Concatenate Strings(w578, ".txt") -> w579
              Build Path(base path=path "E:\\LabviewDAQData", name or relative path=w579) -> (appended path=w576)
              $"FILE PATH" <- w576
            }
            frame 1, Default {
              w576 = s6
            }
          }
          Open Or Create Or Replace File(access (0:read/write)="read/write", file path (use dialog)=w576, operation (0:open)="open or create") -> (refnum out=w580)
          Set File Position(from (0:start)="end", refnum=w580) -> (refnum out=w581)
          Write To Text File(file (use dialog)=w581, text=w575)
          Build Array(w308, w387, w388, w389, w390, w391, w534, w535, w536, w537, w538, w539)
          Is Equal(x=i1, y=99) -> w582
          Logical Or(w582, $"RAMP DOWN") -> w583
          next s6 = w576
          stop if w583
        }
        w584 = $"RAMP DOWN"
        stop if w584
      }
      w306 = w584
    }
  }
  case (w306) {
    frame False, Default {
      w586 = "If instruments ready, press ramp up! If instruments not ready try executing again."
      $"Present State" <- w586
      w585 = FALSE
    }
    frame True {
      w587 = $"Ramp Down Step Width"
      w588 = $"Compliance Level 2"
      case ($"Sourcemeter 2") {
        frame False, Default {
          w589 = TRUE
        }
        frame True {
          s7 = $"Maximum 2"  # shift register
          s8 = 0  # shift register
          while {
            Wait(time to wait=$"Ramp Down Delay")
            Subtract(x=s7, y=w587) -> w590
            case (s8) {
              frame 0, Default {
                w591 = w590
                w589 = FALSE
              }
              frame 1 {
                w591 = 0
                w589 = TRUE
              }
            }
            call "Configure Output.gvi"(VISA resource name=$"VISA resource name out_2", output level=w591, compliance level=w588, source mode="Voltage"(0)) -> (VISA resource name out=w592, error out=w593)
            call "Enable Output.gvi"(VISA resource name=w592, error in=w593, enable output=TRUE) -> (VISA resource name out=w594, error out=w595)
            call "Read (Multiple Points).gvi"(output mode="list"(0), VISA resource name=w594, error in=w595) -> (VISA resource name out=w596, error out=w597, current=w598, voltage=w599)
            $"Voltage Waveform (SourceMeter 2)" <- w599
            call "Enable Output.gvi"(VISA resource name=w596, error in=w597, enable output=TRUE) -> (VISA resource name out=w600, error out=w601)
            Is Greater(x=w590, y=w587) -> w602
            Select(s=w602, t=1, f=0) -> w603
            $"Current Waveform (SourceMeter 2)" <- w598
            next s7 = w591
            next s8 = w603
            stop if w589
          }
        }
      }
      w604 = $"Compliance Level 1"
      # Ramp Down mechanism
      case ($"Sourcemeter 1") {
        frame False, Default {
          w605 = TRUE
        }
        frame True {
          s9 = $"Maximum 1"  # shift register
          s10 = 0  # shift register
          while {
            Wait(time to wait=$"Ramp Down Delay")
            Subtract(x=s9, y=w587) -> w606
            case (s10) {
              frame 0, Default {
                w607 = w606
                w605 = FALSE
              }
              frame 1 {
                w607 = 0
                w605 = TRUE
              }
            }
            call "Configure Output.gvi"(VISA resource name=$"VISA resource name out", output level=w607, compliance level=w604, source mode="Voltage"(0)) -> (VISA resource name out=w608, error out=w609)
            call "Enable Output.gvi"(VISA resource name=w608, error in=w609, enable output=TRUE) -> (VISA resource name out=w610, error out=w611)
            call "Read (Multiple Points).gvi"(output mode="list"(0), VISA resource name=w610, error in=w611) -> (VISA resource name out=w612, error out=w613, current=w614, voltage=w615)
            $"Voltage Waveform (SourceMeter 1)" <- w615
            call "Enable Output.gvi"(VISA resource name=w612, error in=w613, enable output=TRUE) -> (VISA resource name out=w616, error out=w617)
            Is Greater(x=w606, y=w587) -> w618
            Select(s=w618, t=1, f=0) -> w619
            $"Current Waveform (SourceMeter 1)" <- w614
            next s9 = w607
            next s10 = w619
            stop if w605
          }
        }
      }
      case ($Photek) {
        frame False, Default {
          w620 = TRUE
        }
        frame True {
          Wait(time to wait=7000)
          Concatenate Strings("setchannel1,", "0") -> w621
          Concatenate Strings(w621, "\n") -> w622
          call "Write (Instr, String).gvi"(session in=$"session out", write buffer=w622) -> (session out=w623, error out=w624)
          Concatenate Strings("power1", "\n") -> w625
          call "Write (Instr, String).gvi"(session in=w623, error in=w624, write buffer=w625) -> (error out=w626)
          call "Is Error.gvi"(error in=w626) -> (error?=w627)
          Not(x=w627) -> w620
          case (w620) {
            frame False, Default { }
            frame True {
              $Voltage <- "0"
            }
          }
        }
      }
      case ($"LV-PSU") {
        frame False, Default {
          w628 = TRUE
        }
        frame True {
          Concatenate Strings("APP:VOLT ", "0") -> w629
          Concatenate Strings(",", "0") -> w630
          Concatenate Strings(",", "0") -> w631
          Concatenate Strings(w631, w630) -> w632
          Concatenate Strings(w629, w632) -> w633
          call "Write (Instr, String).gvi"(session in=$"session out_2", write buffer=w633) -> (error out=w634)
          call "Is Error.gvi"(error in=w634) -> (error?=w635)
          Not(x=w635) -> w628
          case (w628) {
            frame False, Default { }
            frame True {
              $"Ch-2 Voltage" <- "0"
              $"Ch-1 Voltage" <- "0"
              $"Ch-3 Voltage" <- "0"
            }
          }
        }
      }
      case ($"Channel 1") {
        frame False, Default {
          w636 = TRUE
        }
        frame True {
          Concatenate Strings("$BD:0,CMD:SET,CH:0,PAR:OFF", "\n") -> w637
          call "Write (Instr, String).gvi"(session in=$"session out_4", write buffer=w637) -> (error out=w638)
          call "Is Error.gvi"(error in=w638) -> (error?=w639)
          Not(x=w639) -> w636
        }
      }
      w640 = $"Compliance Level 3"
      case ($"Sourcemeter 3") {
        frame False, Default {
          w641 = TRUE
        }
        frame True {
          s11 = $"Maximum 3"  # shift register
          s12 = 0  # shift register
          while {
            Wait(time to wait=$"Ramp Down Delay")
            Subtract(x=s11, y=w587) -> w642
            case (s12) {
              frame 0, Default {
                w643 = w642
                w641 = FALSE
              }
              frame 1 {
                w643 = 0
                w641 = TRUE
              }
            }
            call "Configure Output.gvi"(VISA resource name=$"VISA resource name out_3", output level=w643, compliance level=w640, source mode="Voltage"(0)) -> (VISA resource name out=w644, error out=w645)
            call "Enable Output.gvi"(VISA resource name=w644, error in=w645, enable output=TRUE) -> (VISA resource name out=w646, error out=w647)
            call "Read (Multiple Points).gvi"(output mode="list"(0), VISA resource name=w646, error in=w647) -> (VISA resource name out=w648, error out=w649, current=w650, voltage=w651)
            $"Voltage Waveform (SourceMeter 3)" <- w651
            call "Enable Output.gvi"(VISA resource name=w648, error in=w649, enable output=TRUE) -> (VISA resource name out=w652, error out=w653)
            Is Greater(x=w642, y=w587) -> w654
            Select(s=w654, t=1, f=0) -> w655
            $"Current Waveform (SourceMeter 3)" <- w650
            next s11 = w643
            next s12 = w655
            stop if w641
          }
        }
      }
      w656 = $"Compliance Level 5"
      case ($"Sourcemeter 5") {
        frame False, Default {
          w657 = TRUE
        }
        frame True {
          s13 = $"Maximum 5"  # shift register
          s14 = 0  # shift register
          while {
            Wait(time to wait=$"Ramp Down Delay")
            Subtract(x=s13, y=w587) -> w658
            case (s14) {
              frame 0, Default {
                w659 = w658
                w657 = FALSE
              }
              frame 1 {
                w659 = 0
                w657 = TRUE
              }
            }
            call "Configure Output.gvi"(VISA resource name=$"VISA resource name out_5", output level=w659, compliance level=w656, source mode="Voltage"(0)) -> (VISA resource name out=w660, error out=w661)
            call "Enable Output.gvi"(VISA resource name=w660, error in=w661, enable output=TRUE) -> (VISA resource name out=w662, error out=w663)
            call "Read (Multiple Points).gvi"(output mode="list"(0), VISA resource name=w662, error in=w663) -> (VISA resource name out=w664, error out=w665, current=w666, voltage=w667)
            $"Voltage Waveform (SourceMeter 5)" <- w667
            call "Enable Output.gvi"(VISA resource name=w664, error in=w665, enable output=TRUE) -> (VISA resource name out=w668, error out=w669)
            Is Greater(x=w658, y=w587) -> w670
            Select(s=w670, t=1, f=0) -> w671
            $"Current Waveform (SourceMeter 5)" <- w666
            next s13 = w659
            next s14 = w671
            stop if w657
          }
        }
      }
      case ($"Channel 2") {
        frame False, Default {
          w672 = TRUE
        }
        frame True {
          Concatenate Strings("$BD:0,CMD:SET,CH:1,PAR:OFF", "\n") -> w673
          call "Write (Instr, String).gvi"(session in=$"session out_4", write buffer=w673) -> (error out=w674)
          call "Is Error.gvi"(error in=w674) -> (error?=w675)
          Not(x=w675) -> w672
        }
      }
      w676 = $"Compliance Level 4"
      case ($"Sourcemeter 4") {
        frame False, Default {
          w677 = TRUE
        }
        frame True {
          s15 = $"Maximum 4"  # shift register
          s16 = 0  # shift register
          while {
            Wait(time to wait=$"Ramp Down Delay")
            Subtract(x=s15, y=w587) -> w678
            case (s16) {
              frame 0, Default {
                w679 = w678
                w677 = FALSE
              }
              frame 1 {
                w679 = 0
                w677 = TRUE
              }
            }
            call "Configure Output.gvi"(VISA resource name=$"VISA resource name out_4", output level=w679, compliance level=w676, source mode="Voltage"(0)) -> (VISA resource name out=w680, error out=w681)
            call "Enable Output.gvi"(VISA resource name=w680, error in=w681, enable output=TRUE) -> (VISA resource name out=w682, error out=w683)
            call "Read (Multiple Points).gvi"(output mode="list"(0), VISA resource name=w682, error in=w683) -> (VISA resource name out=w684, error out=w685, current=w686, voltage=w687)
            $"Voltage Waveform (SourceMeter 4)" <- w687
            call "Enable Output.gvi"(VISA resource name=w684, error in=w685, enable output=TRUE) -> (VISA resource name out=w688, error out=w689)
            Is Greater(x=w678, y=w587) -> w690
            Select(s=w690, t=1, f=0) -> w691
            $"Current Waveform (SourceMeter 4)" <- w686
            next s15 = w679
            next s16 = w691
            stop if w677
          }
        }
      }
      case ($"Channel 3") {
        frame False, Default {
          w692 = TRUE
        }
        frame True {
          Concatenate Strings("$BD:0,CMD:SET,CH:2,PAR:OFF", "\n") -> w693
          call "Write (Instr, String).gvi"(session in=$"session out_4", write buffer=w693) -> (error out=w694)
          call "Is Error.gvi"(error in=w694) -> (error?=w695)
          Not(x=w695) -> w692
        }
      }
      case ($"Channel 4") {
        frame False, Default {
          w696 = TRUE
        }
        frame True {
          Concatenate Strings("$BD:0,CMD:SET,CH:3,PAR:OFF", "\n") -> w697
          call "Write (Instr, String).gvi"(session in=$"session out_4", write buffer=w697) -> (error out=w698)
          call "Is Error.gvi"(error in=w698) -> (error?=w699)
          Not(x=w699) -> w696
        }
      }
      case ($"Channel 5") {
        frame False, Default {
          w700 = TRUE
        }
        frame True {
          Concatenate Strings("$BD:0,CMD:SET,CH:4,PAR:OFF", "\n") -> w701
          call "Write (Instr, String).gvi"(session in=$"session out_4", write buffer=w701) -> (error out=w702)
          call "Is Error.gvi"(error in=w702) -> (error?=w703)
          Not(x=w703) -> w700
        }
      }
      case ($"Channel 6") {
        frame False, Default {
          w704 = TRUE
        }
        frame True {
          Concatenate Strings("$BD:0,CMD:SET,CH:5,PAR:OFF", "\n") -> w705
          call "Write (Instr, String).gvi"(session in=$"session out_4", write buffer=w705) -> (error out=w706)
          call "Is Error.gvi"(error in=w706) -> (error?=w707)
          Not(x=w707) -> w704
        }
      }
      case ($"Channel 7") {
        frame False, Default {
          w708 = TRUE
        }
        frame True {
          Concatenate Strings("$BD:0,CMD:SET,CH:6,PAR:OFF", "\n") -> w709
          call "Write (Instr, String).gvi"(session in=$"session out_4", write buffer=w709) -> (error out=w710)
          call "Is Error.gvi"(error in=w710) -> (error?=w711)
          Not(x=w711) -> w708
        }
      }
      case ($"Channel 8") {
        frame False, Default {
          w712 = TRUE
        }
        frame True {
          Concatenate Strings("$BD:0,CMD:SET,CH:7,PAR:OFF", "\n") -> w713
          call "Write (Instr, String).gvi"(session in=$"session out_4", write buffer=w713) -> (error out=w714)
          call "Is Error.gvi"(error in=w714) -> (error?=w715)
          Not(x=w715) -> w712
        }
      }
      Logical And(w605, w589, w641, w677, w657, w620, w628, w636, w672, w692, w696, w700, w704, w708, w712) -> w585
    }
  }
  case (w585) {
    frame False, Default {
      $"Present State" <- "DID NOT RAMP DOWN EVERYTHING!!"
    }
    frame True {
      # Closing Instruments
      call "Close (Instr).gvi"(session in=$"VISA resource name out") -> (error out=w716)
      call "Is Error.gvi"(error in=w716) -> (error?=w717)
      case ($"Sourcemeter 1 ON") {
        frame False, Default {
          w718 = FALSE
        }
        frame True {
          w718 = w717
        }
      }
      call "Close (Instr).gvi"(session in=$"VISA resource name out_2") -> (error out=w719)
      call "Is Error.gvi"(error in=w719) -> (error?=w720)
      case ($"Sourcemeter 2 ON") {
        frame False, Default {
          w721 = FALSE
        }
        frame True {
          w721 = w720
        }
      }
      call "Close (Instr).gvi"(session in=$"VISA resource name out_3") -> (error out=w722)
      call "Is Error.gvi"(error in=w722) -> (error?=w723)
      case ($"Sourcemeter 3 ON") {
        frame False, Default {
          w724 = FALSE
        }
        frame True {
          w724 = w723
        }
      }
      call "Close (Instr).gvi"(session in=$"VISA resource name out_4") -> (error out=w725)
      call "Is Error.gvi"(error in=w725) -> (error?=w726)
      case ($"Sourcemeter 4 ON") {
        frame False, Default {
          w727 = FALSE
        }
        frame True {
          w727 = w726
        }
      }
      call "Close (Instr).gvi"(session in=$"VISA resource name out_5") -> (error out=w728)
      call "Is Error.gvi"(error in=w728) -> (error?=w729)
      case ($"Sourcemeter 5 ON") {
        frame False, Default {
          w730 = FALSE
        }
        frame True {
          w730 = w729
        }
      }
      Concatenate Strings("power0", "\n") -> w731
      call "Write (Instr, String).gvi"(session in=$"session out", write buffer=w731) -> (session out=w732, error out=w733)
      call "Close (Instr).gvi"(session in=w732, error in=w733) -> (error out=w734)
      call "Is Error.gvi"(error in=w734) -> (error?=w735)
      case ($"Photek ON") {
        frame False, Default {
          w736 = FALSE
        }
        frame True {
          w736 = w735
        }
      }
      call "Close (Instr).gvi"(session in=$"session out_2") -> (error out=w737)
      call "Is Error.gvi"(error in=w737) -> (error?=w738)
      case ($"LV-PSU ON") {
        frame False, Default {
          w739 = FALSE
        }
        frame True {
          w739 = w738
        }
      }
      call "Close (Instr).gvi"(session in=$"session out_3") -> (error out=w740)
      call "Is Error.gvi"(error in=w740) -> (error?=w741)
      case ($"DMM ON") {
        frame False, Default {
          w742 = FALSE
        }
        frame True {
          w742 = w741
        }
      }
      call "Close (Instr).gvi"(session in=$"session out_4") -> (error out=w743)
      call "Is Error.gvi"(error in=w743) -> (error?=w744)
      case ($"Channel 3 ON") {
        frame False, Default {
          w745 = FALSE
        }
        frame True {
          w745 = w744
        }
      }
      case ($"Channel 7 ON") {
        frame False, Default {
          w746 = FALSE
        }
        frame True {
          w746 = w744
        }
      }
      case ($"Channel 1 ON") {
        frame False, Default {
          w747 = FALSE
        }
        frame True {
          w747 = w744
        }
      }
      case ($"Channel 2 ON") {
        frame False, Default {
          w748 = FALSE
        }
        frame True {
          w748 = w744
        }
      }
      case ($"Channel 4 ON") {
        frame False, Default {
          w749 = FALSE
        }
        frame True {
          w749 = w744
        }
      }
      case ($"Channel 5 ON") {
        frame False, Default {
          w750 = FALSE
        }
        frame True {
          w750 = w744
        }
      }
      case ($"Channel 6 ON") {
        frame False, Default {
          w751 = FALSE
        }
        frame True {
          w751 = w744
        }
      }
      case ($"Channel 8 ON") {
        frame False, Default {
          w752 = FALSE
        }
        frame True {
          w752 = w744
        }
      }
      Logical Or(w718, w721, w724, w727, w730, w736, w739, w742, w747, w748, w745, w749, w750, w751, w746, w752) -> w753
      $"ALL INSTRUMENTS" <- w753
      Not(x=$"Sourcemeter 1 ON") -> w754
      Not(x=w717) -> w755
      Logical And(w754, w755) -> w756
      $"Sourcemeter 1" <- w756
      Not(x=$"Sourcemeter 2 ON") -> w757
      Not(x=w720) -> w758
      Logical And(w757, w758) -> w759
      $"Sourcemeter 2" <- w759
      Not(x=$"Sourcemeter 3 ON") -> w760
      Not(x=w723) -> w761
      Logical And(w760, w761) -> w762
      $"Sourcemeter 3" <- w762
      Not(x=$"Sourcemeter 4 ON") -> w763
      Not(x=w726) -> w764
      Logical And(w763, w764) -> w765
      $"Sourcemeter 4" <- w765
      Not(x=$"Sourcemeter 5 ON") -> w766
      Not(x=w729) -> w767
      Logical And(w766, w767) -> w768
      $"Sourcemeter 5" <- w768
      Not(x=$"Photek ON") -> w769
      Not(x=w735) -> w770
      Logical And(w769, w770) -> w771
      $Photek <- w771
      Not(x=$"LV-PSU ON") -> w772
      Not(x=w738) -> w773
      Logical And(w772, w773) -> w774
      $"LV-PSU" <- w774
      Not(x=w741) -> w775
      Not(x=$"DMM ON") -> w776
      Logical And(w776, w775) -> w777
      $DMM <- w777
      Not(x=w744) -> w778
      Not(x=$"Channel 1 ON") -> w779
      Logical And(w779, w778) -> w780
      $"Channel 1" <- w780
      Not(x=w744) -> w781
      Not(x=$"Channel 2 ON") -> w782
      Logical And(w782, w781) -> w783
      $"Channel 2" <- w783
      Not(x=w744) -> w784
      Not(x=$"Channel 3 ON") -> w785
      Logical And(w785, w784) -> w786
      $"Channel 3" <- w786
      Not(x=w744) -> w787
      Not(x=$"Channel 4 ON") -> w788
      Logical And(w788, w787) -> w789
      $"Channel 4" <- w789
      Not(x=w744) -> w790
      Not(x=$"Channel 5 ON") -> w791
      Logical And(w791, w790) -> w792
      $"Channel 5" <- w792
      Not(x=w744) -> w793
      Not(x=$"Channel 6 ON") -> w794
      Logical And(w794, w793) -> w795
      $"Channel 6" <- w795
      Not(x=w744) -> w796
      Not(x=$"Channel 7 ON") -> w797
      Logical And(w797, w796) -> w798
      $"Channel 7" <- w798
      Not(x=w744) -> w799
      Not(x=$"Channel 8 ON") -> w800
      Logical And(w800, w799) -> w801
      $"Channel 8" <- w801
    }
  }
  Not(x=w585) -> w802
  $"RAMP DOWN" <- w802
